# Grasshopper definition BA_main.gh (Grasshopper 1.0.8)

multiplication = Multiplication(A=Slider(4, range=0..100), B=2)
vec = VectorXYZ(XComponent=Slider(10, range=0..10), YComponent=0, ZComponent=0)  # -> Vector, Length
addition = Addition(A=multiplication, B=1)
pt = ConstructPoint(XCoordinate=0, YCoordinate=0, ZCoordinate=0)
arrlinear = LinearArray(Geometry=pt, Direction=vec.Vector, Count=addition)  # -> Geometry, Transform
series = Series(Start=0, Step=vec.Vector, Count=addition)
Y = UnitY(Factor=series)
move = Move(Geometry=arrlinear.Geometry, Motion=graft(Y))  # -> Geometry, Transform
sort_pt = SortPoints(Points=flatten(move.Geometry))  # -> Points, Indices
dispatch = Dispatch(List=flatten(sort_pt.Points), DispatchPattern=[True, False])  # -> ListA, ListB
xz = XZPlane(Origin=Point(0, 0, 0))
Z = UnitZ(Factor=Slider(4.594, range=0..10))
move_2 = Move(Geometry=dispatch.ListA, Motion=Z)  # -> Geometry, Transform
geo = Geometry([move_2.Geometry, dispatch.ListB])
sort_pt_2 = SortPoints(Points=geo)  # -> Points, Indices
pdecon = Deconstruct(Point=sort_pt_2.Points)  # -> XComponent, YComponent, ZComponent
partition = PartitionList(List=sort_pt_2.Points, Size=9)
intcrv_t = InterpolateT(Vertices=partition, TangentStart=Vector(0, 0, 0), TangentEnd=Vector(0, 0, 0), KnotStyle=1)  # -> flatten(Curve), Length, Domain
sort = SortList(Keys=pdecon.YComponent, ValuesA=sort_pt_2.Points)  # -> Keys, ValuesA
srfgrid = SurfaceFromPoints(Points=sort_pt_2.Points, UCount=addition, Interpolate=False)  # disabled
partition_2 = PartitionList(List=sort.ValuesA, Size=9)
pdecon_2 = Deconstruct(Point=partition_2)  # -> XComponent, YComponent, ZComponent
sort_2 = SortList(Keys=pdecon_2.XComponent, ValuesA=partition_2)  # -> Keys, ValuesA
intcrv_t_2 = InterpolateT(Vertices=sort_2.ValuesA, TangentStart=Vector(0, 0, 0), TangentEnd=Vector(0, 0, 0), KnotStyle=1)  # -> flatten(Curve), Length, Domain
netsurf = NetworkSurface(CurvesU=intcrv_t.Curve, CurvesV=intcrv_t_2.Curve, Continuity=2)
rotate = Rotate(Geometry=netsurf, Angle=1.570796327, Plane=xz)  # -> Geometry, Transform

funnel_polysrf = Brep(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)
funnel_mantle = Surface(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)

lion_projected = Curve([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])
lion = Curve([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])

starting_curve = Curve(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)
generating_mesh_with_meshlib = Python3Script(surface=funnel_mantle, curve=starting_curve)  # -> out, meshlib_mesh
# ---------- generating_mesh_with_meshlib: Python ----------
import meshlib.mrmeshpy
from meshlib.mrmeshpy import Vector3f, MeshBuilder
from meshlib.mrmeshpy import std_vector_std_array_Vector3_float_3 as VecOfTri
from meshlib.mrmeshpy import std_array_Vector3_float_3 as TriArray

import Rhino
import numpy as np
import meshlib.mrmeshpy as mr
import rhinoscriptsyntax as rs
import Rhino.Geometry as rg

# INPUT: gh_surface — Rhino surface input from Grasshopper

# 1. Coerce to Brep
brep = rs.coercebrep(surface)
if brep and brep.IsValid:
    # Define custom meshing parameters
    mp = rg.MeshingParameters().Default
    #mp.GridQuads = False  # Disable quad generation
    #mp.RefineGrid = True
    #mp.SimplePlanes = False
    #mp.MinimumEdgeLength = 0.01  # Adjust based on desired mesh density
    #mp.MaximumEdgeLength = 0.5   # Adjust based on desired mesh density
    #mp.Tolerance = 0.01
    #mp.RelativeTolerance = 0.01

    # Generate mesh from Brep
    brep_meshes = rg.Mesh.CreateFromBrep(brep, mp)

    if brep_meshes:
        # Combine all sub-meshes into one
        mesh = rg.Mesh()
        for m in brep_meshes:
            mesh.Append(m)

        # Convert any remaining quads to triangles
        mesh.Faces.ConvertQuadsToTriangles()
        mesh.Normals.ComputeNormals()
        mesh.Compact()


# Convert Rhino mesh vertices and triangular faces to arrays
vertices = np.array([[v.X, v.Y, v.Z] for v in mesh.Vertices])
faces = np.array([[f.A, f.B, f.C] for f in mesh.Faces if f.IsTriangle])

posTriples = VecOfTri()

# Convert each triangular face into a TriArray
for face in faces:
    tri = TriArray()
    for i in range(3):
        v = vertices[face[i]]
        tri[i] = Vector3f(float(v[0]), float(v[1]), float(v[2]))
    posTriples.append(tri)

# Build the mesh
meshlib_mesh = MeshBuilder.fromPointTriples(posTriples)
# ---------- end generating_mesh_with_meshlib ----------
old_with_trimesh = Python3Script(surface=funnel_mantle, curve=starting_curve)  # -> out, b, c, a, mesh, curves, edge_curve, tri_mesh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
# ---------- old_with_trimesh: Python ----------
import Rhino
import numpy as np
import meshlib.mrmeshpy as mr
import rhinoscriptsyntax as rs
import Rhino.Geometry as rg
import trimesh as tr

# INPUT: gh_surface — Rhino surface input from Grasshopper

# 1. Coerce to Brep
brep = rs.coercebrep(surface)
if brep and brep.IsValid:
    # Define custom meshing parameters
    mp = rg.MeshingParameters().Default
    #mp.GridQuads = False  # Disable quad generation
    #mp.RefineGrid = True
    #mp.SimplePlanes = False
    #mp.MinimumEdgeLength = 0.01  # Adjust based on desired mesh density
    #mp.MaximumEdgeLength = 50   # Adjust based on desired mesh density
    #mp.Tolerance = 0.01
    #mp.RelativeTolerance = 0.01

    # Generate mesh from Brep
    brep_meshes = rg.Mesh.CreateFromBrep(brep, mp)

    if brep_meshes:
        # Combine all sub-meshes into one
        mesh = rg.Mesh()
        for m in brep_meshes:
            mesh.Append(m)

        # Convert any remaining quads to triangles
        mesh.Faces.ConvertQuadsToTriangles()
        mesh.Normals.ComputeNormals()
        mesh.Compact()


# Convert Rhino mesh vertices and triangular faces to arrays
vertices = np.array([[v.X, v.Y, v.Z] for v in mesh.Vertices])
faces = np.array([[f.A, f.B, f.C] for f in mesh.Faces if f.IsTriangle])



V = np.array(vertices, dtype=np.float32)  # Shape: (n_vertices, 3)
F = np.array(faces, dtype=np.int32)

triangles = V[F]  # Shape: (n_faces, 3, 3)

tri_mesh = tr.Trimesh(vertices=V, faces=F, process=False)
# ---------- end old_with_trimesh ----------
mesh = Mesh(old_with_trimesh.mesh)
pt_2 = Point(<point referenced from the Rhino model>)
pt_3 = Point(Point(7993.126374, -4322.762964, 174.9374951))
mesh_2 = Mesh(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)
pt_4 = Point(Point(8538.545503, -3463.555415, 375.2295546))
pt_5 = Point(<point referenced from the Rhino model>)
pt_6 = Point(<point referenced from the Rhino model>)
pt_7 = Point(<point referenced from the Rhino model>)
pt_8 = Point(<point referenced from the Rhino model>)
pt_9 = Point(<point referenced from the Rhino model>)
pt_10 = Point(<point referenced from the Rhino model>)
get_tangent_basis = Python3Script(tri_mesh=old_with_trimesh.tri_mesh, query_point_1=pt_2)  # -> out, a, b, c, d
# ---------- get_tangent_basis: Python ----------
import sys 
import numpy as np
from numpy.linalg import norm
import trimesh as tr
import meshlib.mrmeshpy as mrmesh
import rhinoscriptsyntax as rs
import Rhino.Geometry as rg
import importlib

module_path = r"C:\Users\merli\Desktop\BA_thesis\sfc_python_implementation\functions&classes"
if module_path not in sys.path:
    sys.path.append(module_path)

import SurfacePoint
import point_point_geodesic
import get_tangent_basis  # Assuming you stored your function here

importlib.reload(SurfacePoint)
importlib.reload(point_point_geodesic)
importlib.reload(get_tangent_basis)

from SurfacePoint import SurfacePoint
from point_point_geodesic import point_point_geodesic
from get_tangent_basis import get_tangent_basis  # your function

# query_point_1 is already: np.array([[x, y, z]])
# tri_mesh is already available

query_point_1 = rs.coerce3dpoint(query_point_1)
query_point_1 = np.array([[query_point_1.X, query_point_1.Y, query_point_1.Z]])

query_point_flat = query_point_1.flatten().tolist()

sp1 = SurfacePoint.from_position(query_point_flat, tri_mesh)

tangent, bitangent, normal = get_tangent_basis(tri_mesh, sp1)

tangent_vector = rg.Vector3d(*tangent)
bitangent_vector = rg.Vector3d(*bitangent)
normal_vector = rg.Vector3d(*normal)

# Create anchor point for vector display
anchor_point = rg.Point3d(*sp1.coord3d)

# Grasshopper outputs
a = anchor_point
b = tangent_vector
c = bitangent_vector
d = normal_vector
# ---------- end get_tangent_basis ----------
adjacent_case_for_geodesics = Python3Script(mesh=mesh_2, p0=pt_3, p1=pt_4)  # -> out, polyline, vertices
# ---------- adjacent_case_for_geodesics: Python ----------
""" 
Inputs: 
    mesh: Mesh
    p0: Point3d (SurfacePoint converted to 3d)
    p1: Point3d (SurfacePoint converted to 3d)
    vi0: int (index of first vertex of edge)
    vi1: int (index of second vertex of edge)

Output:
    edge_point: Point3d (optimal crossing point)
"""

import Rhino
import math
import rhinoscriptsyntax as rs
import scriptcontext as sc
import System
import clr

mesh = rs.coercemesh(mesh)

# Coerce points just in case
P0 = rs.coerce3dpoint(p0)
P1 = rs.coerce3dpoint(p1)

vertices = [Rhino.Geometry.Point3d(v) for v in mesh.Vertices]

# Get edge vertices from mesh
V0 = mesh.Vertices[1]
V1 = mesh.Vertices[3]

# Convert mesh vertices to Point3d
V0 = Rhino.Geometry.Point3d(V0)
V1 = Rhino.Geometry.Point3d(V1)

# Compute distances
l = V0.DistanceTo(V1)

l0_0 = P0.DistanceTo(V0)
l0_1 = P0.DistanceTo(V1)
l1_0 = P1.DistanceTo(V0)
l1_1 = P1.DistanceTo(V1)

# Safe acos function to prevent domain errors
def safe_acos(x):
    return math.acos(max(min(x, 1.0), -1.0))

# Compute angles
theta0_0 = safe_acos((P0 - V0) * (V1 - V0) / (l0_0 * l))
theta0_1 = safe_acos((P0 - V1) * (V0 - V1) / (l0_1 * l))
theta1_0 = safe_acos((P1 - V0) * (V1 - V0) / (l1_0 * l))
theta1_1 = safe_acos((P1 - V1) * (V0 - V1) / (l1_1 * l))

theta_0 = theta0_0 + theta1_0
theta_1 = theta0_1 + theta1_1

# Compute triangle areas
area_tri1 = l0_0 * l1_0 * math.sin(theta_0) / 2.0
area_tri2 = l0_1 * l1_1 * math.sin(theta_1) / 2.0

total_area = area_tri1 + area_tri2

if total_area == 0:
    ratio = 0.5  # fallback to midpoint
else:
    ratio = area_tri1 / total_area

# Clamp ratio
ratio = max(min(ratio, 1.0), 0.0)

# Compute optimal point on edge
edge_point = V0 + ratio * (V1 - V0)

polyline = Rhino.Geometry.Polyline([P0, edge_point, P1])
polyline = Rhino.Geometry.PolylineCurve(polyline)
# ---------- end adjacent_case_for_geodesics ----------
surfac_point_class = Python3Script(tri_mesh=old_with_trimesh.tri_mesh_2, query_point_1=pt_7, query_point_2=pt_5, query_point_3=pt_6)  # -> out, a
# ---------- surfac_point_class: Python ----------
import sys
import os
import rhinoscriptsyntax as rs
import trimesh as tr

# Add your custom module path
module_path = r"C:\Users\merli\Desktop\BA_thesis\sfc_python_implementation\functions&classes"
if module_path not in sys.path:
    sys.path.append(module_path)

# Force reload to avoid using cached version
import importlib
import SurfacePoint
import surface_point_to_cartesian
importlib.reload(SurfacePoint)
importlib.reload(surface_point_to_cartesian)

from SurfacePoint import SurfacePoint
from surface_point_to_cartesian import surface_point_to_cartesian
##############################################################

#tri_mesh = tr.Trimesh(vertices=V, faces=F, process=False)

print(type(tri_mesh))

# Coerce and convert points to XYZ lists
query_point_1 = rs.coerce3dpoint(query_point_1)
query_point_1 = [query_point_1.X, query_point_1.Y, query_point_1.Z]

query_point_2 = rs.coerce3dpoint(query_point_2)
query_point_2 = [query_point_2.X, query_point_2.Y, query_point_2.Z]

query_point_3 = rs.coerce3dpoint(query_point_3)
query_point_3 = [query_point_3.X, query_point_3.Y, query_point_3.Z]

# Create SurfacePoint instances
sp1 = SurfacePoint.from_position(query_point_1, tri_mesh)
sp2 = SurfacePoint.from_position(query_point_2, tri_mesh)
sp3 = SurfacePoint.from_position(query_point_3, tri_mesh)

print("sp1 type:", sp1.type)
print("sp2 type:", sp2.type)
print("sp3 type:", sp3.type)

print("sp1 top_indices:", sp1.top_indices)
print("sp2 top_indices:", sp2.top_indices)
print("sp3 top_indices:", sp3.top_indices)

print("sp1 location:", sp1.coord3d)
print("sp2 location:", sp2.coord3d)
print("sp3 location:", sp3.coord3d)

print("sp1 face_indices:", sp1.face_indices)
print("sp2 face_indices:", sp2.face_indices)
print("sp3 face_indices:", sp3.face_indices)
# ---------- end surfac_point_class ----------
surfac_point_class_2 = Python3Script(tri_mesh=old_with_trimesh.tri_mesh_2, query_point_1=pt_8, query_point_2=pt_9, query_point_3=pt_10)  # -> out, a
# ---------- surfac_point_class_2: Python ----------
import sys
import os
import rhinoscriptsyntax as rs
import trimesh as tr

# Add your custom module path
module_path = r"C:\Users\merli\Desktop\BA_thesis\sfc_python_implementation\functions&classes"
if module_path not in sys.path:
    sys.path.append(module_path)

# Force reload to avoid using cached version during development
import importlib
import SurfacePoint_evolved
import surface_point_to_cartesian
importlib.reload(SurfacePoint_evolved)
importlib.reload(surface_point_to_cartesian)

from SurfacePoint_evolved import SurfacePoint
from surface_point_to_cartesian import surface_point_to_cartesian

##############################################################

# Make sure tri_mesh is already provided (passed from GH input)
# e.g. tri_mesh = tr.Trimesh(vertices=V, faces=F, process=False)
print(type(tri_mesh))

# Coerce and convert input points to proper format
query_point_1 = rs.coerce3dpoint(query_point_1)
query_point_1 = [query_point_1.X, query_point_1.Y, query_point_1.Z]

query_point_2 = rs.coerce3dpoint(query_point_2)
query_point_2 = [query_point_2.X, query_point_2.Y, query_point_2.Z]

query_point_3 = rs.coerce3dpoint(query_point_3)
query_point_3 = [query_point_3.X, query_point_3.Y, query_point_3.Z]

# Create SurfacePoint instances using the new SurfacePoint.from_position
sp1 = SurfacePoint.from_position(query_point_1, tri_mesh)
sp2 = SurfacePoint.from_position(query_point_2, tri_mesh)
sp3 = SurfacePoint.from_position(query_point_3, tri_mesh)

# Print for debug
print("sp1 type:", sp1.type)
print("sp2 type:", sp2.type)
print("sp3 type:", sp3.type)

print("sp1 top_indices:", sp1.top_indices)
print("sp2 top_indices:", sp2.top_indices)
print("sp3 top_indices:", sp3.top_indices)

print("sp1 location:", sp1.coord3d)
print("sp2 location:", sp2.coord3d)
print("sp3 location:", sp3.coord3d)

print("sp1 face_indices:", sp1.face_indices)
print("sp2 face_indices:", sp2.face_indices)
print("sp3 face_indices:", sp3.face_indices)

# Now print barycentric coordinates as well
print("sp1 barycentric coordinates:", sp1.bary)
print("sp2 barycentric coordinates:", sp2.bary)
print("sp3 barycentric coordinates:", sp3.bary)

# Optional: output to Grasshopper outputs
a = sp1.type, sp2.type, sp3.type
b = sp1.top_indices, sp2.top_indices, sp3.top_indices
c = sp1.coord3d, sp2.coord3d, sp3.coord3d
d = sp1.face_indices, sp2.face_indices, sp3.face_indices
e = sp1.face_index, sp2.face_index, sp3.face_index
f = sp1.bary, sp2.bary, sp3.bary
# ---------- end surfac_point_class_2 ----------
testing_trimesh_for_what_its_worth = Python3Script(tri_mesh=old_with_trimesh.tri_mesh)  # -> out, a
# ---------- testing_trimesh_for_what_its_worth: Python ----------
import sys 
import numpy as np
from numpy.linalg import norm
import trimesh as tr
import meshlib.mrmeshpy as mrmesh
import Rhino.Geometry as rg
import importlib
import rhinoscriptsyntax as rs

# You don't need rhinoscriptsyntax inside Grasshopper
# import rhinoscriptsyntax as rs

# Append your module path
module_path = r"C:\Users\merli\Desktop\BA_thesis\sfc_python_implementation\functions&classes"
if module_path not in sys.path:
    sys.path.append(module_path)

# Import your custom modules
import SurfacePoint
import point_point_geodesic
import get_tangent_basis
#import trace_geodesic

# Reload to make sure changes are applied when testing
importlib.reload(SurfacePoint)
importlib.reload(point_point_geodesic)
importlib.reload(get_tangent_basis)
#importlib.reload(trace_geodesic)  

from SurfacePoint import SurfacePoint
from point_point_geodesic import point_point_geodesic
from get_tangent_basis import get_tangent_basis
#from trace_geodesic import trace_geodesic

##########################3


# Ensure tri_mesh is a valid Trimesh object
if not isinstance(tri_mesh, tr.Trimesh):
    print("Input 'tri_mesh' is not a valid Trimesh object.")
else:
    # --- Face Adjacency ---
    # Returns pairs of face indices that share an edge, indicating adjacent faces.
    print("=== face_adjacency ===")
    adjacency = tri_mesh.face_adjacency
    print("Type:", type(adjacency))
    print("Shape:", adjacency.shape)
    print("Sample, THESE ARE ALL FACE INDICES:\n", adjacency[:5])

    # --- Face Adjacency Edges ---
    # Provides the vertex indices of the edges shared by adjacent face pairs.
    print("\n=== face_adjacency_edges ===")
    adj_edges = tri_mesh.face_adjacency_edges
    print("Type:", type(adj_edges))
    print("Shape:", adj_edges.shape)
    print("Sample:\n", adj_edges[:5])

    # --- Face Adjacency Edges Tree ---
    # A KDTree built from the sorted shared edges, allowing efficient queries to find adjacency information based on edges.
    print("\n=== face_adjacency_edges_tree ===")
    adj_edges_tree = tri_mesh.face_adjacency_edges_tree
    print("Type:", type(adj_edges_tree))
    print("Data shape:", adj_edges_tree.data.shape)
    # THE INPUT ARE VERTEX INDICES
    print("Sample:", adj_edges_tree.query(np.sort(np.array([3, 11]))))

    


    # --- Face Adjacency Unshared ---
    # For each pair of adjacent faces, returns the vertex indices that are not part of the shared edge.
    print("\n=== face_adjacency_unshared ===")
    adj_unshared = tri_mesh.face_adjacency_unshared
    print("Type:", type(adj_unshared))
    print("Shape:", adj_unshared.shape)
    print("Sample:\n", adj_unshared[:5])

    # --- Face Adjacency Projections ---
    # Calculates the projection of the non-shared vertex of one triangle onto the plane of its adjacent triangle.
    print("\n=== face_adjacency_projections ===")
    adj_proj = tri_mesh.face_adjacency_projections
    print("Type:", type(adj_proj))
    print("Shape:", adj_proj.shape)
    print("Sample:\n", adj_proj[:5])

    # --- Face Adjacency Tree ---
    # An R-tree of face adjacencies, facilitating spatial queries like finding neighboring faces within a certain radius.
    print("\n=== face_adjacency_tree ===")
    adj_tree = tri_mesh.face_adjacency_tree
    print("Type:", type(adj_tree))

    # --- Face Neighborhood ---
    # Returns pairs of face indices that share at least one vertex, indicating neighboring faces.
    print("\n=== face_neighborhood ===")
    face_neigh = tri_mesh.face_neighborhood
    print("Type:", type(face_neigh))
    print("Shape:", face_neigh.shape)
    print("Sample:\n", face_neigh[:5])

    # --- Edges ---
    # Lists all edges in the mesh, including duplicates if an edge is shared by multiple faces.
    print("\n=== edges ===")
    edges = tri_mesh.edges
    print("Type:", type(edges))
    print("Shape:", edges.shape)
    print("Sample:\n", edges[:5])

    # --- Edges Face ---
    # For each edge in 'edges', provides the index of the face that contains it.
    print("\n=== edges_face ===")
    edges_face = tri_mesh.edges_face
    print("Type:", type(edges_face))
    print("Shape:", edges_face.shape)
    print("Sample:\n", edges_face[10])

    # --- Edges Sorted ---
    # Provides a sorted version of 'edges', where each edge's vertex indices are ordered.
    print("\n=== edges_sorted ===")
    edges_sorted = tri_mesh.edges_sorted
    print("Type:", type(edges_sorted))
    print("Shape:", edges_sorted.shape)
    print("Sample:\n", edges_sorted[:5])

    # --- Edges Sorted Tree ---
    # A KDTree built from 'edges_sorted', enabling efficient spatial queries on edges.
    print("\n=== edges_sorted_tree ===")
    edges_sorted_tree = tri_mesh.edges_sorted_tree
    print("Type:", type(edges_sorted_tree))
    print("Data shape:", edges_sorted_tree.data.shape)
# ---------- end testing_trimesh_for_what_its_worth ----------
scale = Scale(Geometry=[get_tangent_basis.c, get_tangent_basis.b, get_tangent_basis.d], Center=Point(0, 0, 0), Factor=1000)  # -> Geometry, Transform
crv = Curve(testing_trimesh_for_what_its_worth.a)
panel = Panel(testing_trimesh_for_what_its_worth.out)
item = ListItem(List=adjacent_case_for_geodesics.vertices, Index=Slider(2, range=0..100), Wrap=True)
vdis = VectorDisplay(Anchor=get_tangent_basis.a, Vector=scale.Geometry)

# ---- group: trace_geodesic
vec_2 = VectorXYZ(XComponent=Slider(-0.256, range=-1..1), YComponent=Slider(1, range=-1..1), ZComponent=Slider(-0.204, range=-1..1))  # -> Vector, Length
scale_2 = Scale(Geometry=vec_2.Vector, Center=Point(0, 0, 0), Factor=Slider(20679.9, range=0..100000))  # -> Geometry, Transform
pt_11 = Point(<point referenced from the Rhino model>)
trace_geodesic = Python3Script(
    tri_mesh=old_with_trimesh.tri_mesh,
    meshlib_mesh=generating_mesh_with_meshlib.meshlib_mesh,
    query_point_1=pt_11,
    direction=scale_2.Geometry)  # -> out, a
# ---------- trace_geodesic: Python ----------
import sys
import os
import rhinoscriptsyntax as rs
import trimesh as tr
import numpy as np

import Rhino.Geometry as rg

# Add your custom module path
module_path = r"C:\Users\merli\Desktop\BA_thesis\sfc_python_implementation\functions&classes"
if module_path not in sys.path:
    sys.path.append(module_path)

# Import your external files
import importlib
import SurfacePoint_evolved
import trace_geodesic
importlib.reload(SurfacePoint_evolved)
importlib.reload(trace_geodesic)

from SurfacePoint_evolved import SurfacePoint
from trace_geodesic import trace_geodesic

##############################################################

# Convert GH query_point input into numpy 3D point
query_point = rs.coerce3dpoint(query_point_1)
query_point = [query_point.X, query_point.Y, query_point.Z]

# Convert GH direction input into numpy array
direction = rs.coerce3dvector(direction)
direction = np.array([direction.X, direction.Y, direction.Z])

# Make sure your tri_mesh is a trimesh object already
# tri_mesh = tr.Trimesh(vertices=V, faces=F, process=False)
print(type(tri_mesh))

# Create SurfacePoint instance for starting point
start_point = SurfacePoint.from_position(query_point, tri_mesh)

# Initialize potpourri3d tracer
import potpourri3d as pp3d
V, F = tri_mesh.vertices, tri_mesh.faces
tracer = pp3d.GeodesicTracer(V, F)

# Call your trace_geodesic function
distance = 1.0  # or any distance you want to trace for testing
surface_points = trace_geodesic(tri_mesh, start_point, direction, tracer)

# Output results
# Extract coordinate positions of traced SurfacePoints for GH visualization
result_coords = [sp.coord3d for sp in surface_points]

# Output both full SurfacePoint objects and 3D coordinates for debugging
a =  [rg.Point3d(pt[0],pt[1],pt[2]) for pt in result_coords]
# ---------- end trace_geodesic ----------
panel_2 = Panel(trace_geodesic.out)
pline = PolyLine(Vertices=trace_geodesic.a, Closed=False)

# ---- group: find_geodesic
pt_12 = Point(<point referenced from the Rhino model>)
pt_13 = Point(<point referenced from the Rhino model>)
find_geodesic = Python3Script(
    tri_mesh=old_with_trimesh.tri_mesh,
    meshlib_mesh=generating_mesh_with_meshlib.meshlib_mesh,
    query_point_1=pt_12,
    query_point_2=pt_13)  # -> out, a
# ---------- find_geodesic: Python ----------
import sys
import numpy as np
from numpy.linalg import norm
import trimesh as tr
import meshlib.mrmeshpy as mrmesh
import rhinoscriptsyntax as rs
import Rhino.Geometry as rg
import importlib

module_path = r"C:\Users\merli\Desktop\BA_thesis\sfc_python_implementation\functions&classes"
if module_path not in sys.path:
    sys.path.append(module_path)

import SurfacePoint
import point_point_geodesic

importlib.reload(SurfacePoint)
importlib.reload(point_point_geodesic)

from SurfacePoint import SurfacePoint
from point_point_geodesic import point_point_geodesic

###########################################################


def point3d_to_list(pt):
    pt = rs.coerce3dpoint(pt)
    return [pt.X, pt.Y, pt.Z]

query_point_1 = rs.coerce3dpoint(query_point_1)
query_point_2 = rs.coerce3dpoint(query_point_2)

query_point_1 = np.array([[query_point_1.X, query_point_1.Y, query_point_1.Z]])
query_point_2 = np.array([[query_point_2.X, query_point_2.Y, query_point_2.Z]])

#tri_mesh = tr.Trimesh(vertices=V, faces=F, process=False)

sp1 = SurfacePoint.from_position(query_point_1, tri_mesh)
sp2 = SurfacePoint.from_position(query_point_2, tri_mesh)

path12, len12 = point_point_geodesic(tri_mesh, meshlib_mesh, sp1, sp2)

def path_to_polyline(path):
    return rg.Polyline([rg.Point3d(*pt.coord3d) for pt in path])

Polyline12 = path_to_polyline(path12)

print(path12)

a = Polyline12
lengths = [len12]
# ---------- end find_geodesic ----------
panel_3 = Panel(find_geodesic.out)
crv_2 = Curve(find_geodesic.a)

# ----
crv_3 = Curve(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)
medial_axis = Python3Script(tri_mesh=old_with_trimesh.tri_mesh, crv_guid=crv_3, n=Slider(20, range=0..100))  # -> out, a; inputs n: Int32
# ---------- medial_axis: Python ----------
import sys
import os
import rhinoscriptsyntax as rs
import trimesh as tr
import numpy as np
import Rhino.Geometry as rg

# Add your custom module path
module_path = r"C:\Users\merli\Desktop\BA_thesis\sfc_python_implementation\functions&classes"
if module_path not in sys.path:
    sys.path.append(module_path)

# Import your external files
import importlib
import SurfacePoint_evolved
import trace_geodesic
import medial_axis  # <-- this is your medial_axis code file

importlib.reload(SurfacePoint_evolved)
importlib.reload(trace_geodesic)
importlib.reload(medial_axis)

from SurfacePoint_evolved import SurfacePoint
from trace_geodesic import trace_geodesic
from medial_axis import medial_axis

####################################

import Rhino
import rhinoscriptsyntax as rs
import scriptcontext as sc
import numpy as np

# --- INPUTS ---
# crv_guid: curve GUID input
# n: number of points to sample (integer)
# tri_mesh: trimesh object already given (Trimesh loaded in Python)

# --- Step 1: Coerce curve from GUID ---
curve = rs.coercecurve(crv_guid)
print("Loaded curve:", curve)

# --- Step 2: Discretize curve into n points ---
curve_domain = curve.Domain
params = np.linspace(curve_domain[0], curve_domain[1], n)
curve_points = [curve.PointAt(t) for t in params]

# Convert Rhino points to numpy arrays
points = [np.array([pt.X, pt.Y, pt.Z]) for pt in curve_points]
print("Sampled points along curve:")
for i, pt in enumerate(points):
    print(f"  Point {i}: {pt}")

# --- Step 3: Prepare empty lists ---
nodeTangents = []
nodeNormals = []
nodeBitangents = []

# --- Step 4: Loop over points and project to mesh ---
for idx, pt in enumerate(points):
    print(f"\nProcessing point {idx}: {pt}")
    
    # Project point onto mesh
    projected, distance, face_id = tri_mesh.nearest.on_surface([pt])
    projected_point = projected[0]
    face_id = face_id[0]

    print(f"  Projected to mesh: {projected_point} (face {face_id})")

    # Get mesh normal at face
    normal = tri_mesh.face_normals[face_id]
    print(f"  Mesh normal: {normal}")

    # Get tangent from curve (find closest param on curve to projected point)
    success, param_closest = curve.ClosestPoint(Rhino.Geometry.Point3d(*projected_point))

    if success:
        tangent_vector = curve.TangentAt(param_closest)
    else:
        # This is a rare fallback in case projection fails (highly unlikely)
        tangent_vector = curve.TangentAt(curve.Domain.T0)

    tangent = np.array([tangent_vector.X, tangent_vector.Y, tangent_vector.Z])
    tangent /= np.linalg.norm(tangent)
    print(f"  Curve tangent: {tangent}")

    # Compute bitangent
    bitangent = np.cross(normal, tangent)
    bitangent /= np.linalg.norm(bitangent)
    print(f"  Bitangent: {bitangent}")

    nodeTangents.append(tangent)
    nodeNormals.append(normal)
    nodeBitangents.append(bitangent)

# --- Step 5: Call medial_axis ---
maxRadius = 100000000.0  # You can later expose this as Grasshopper input
nodes = [None] * len(points)  # Dummy nodes list

print("\nCalling medial_axis...")
medial_axis_result = medial_axis(
    nodes, points, nodeTangents, nodeNormals, nodeBitangents, maxRadius, isGeodesic=False
)

# --- Step 6: Convert medial axis points to Rhino geometry for output ---
result_points = []
for i, pt_pair in enumerate(medial_axis_result):
    print(f"Medial axis for point {i}:")
    for pt in pt_pair:
        print(f"  {pt}")
        result_points.append(Rhino.Geometry.Point3d(*pt))

# --- OUTPUT ---
a = result_points
# ---------- end medial_axis ----------
pt_14 = Point(medial_axis.a)
panel_4 = Panel(medial_axis.out)
