# Grasshopper definition BA_main_5_test2.gh (Grasshopper 1.0.8)

brep = Brep(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)
srf = Surface(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)
srf_2 = Surface()
brep_2 = Brep(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)
trim = TrimSolid(Shape=srf, Cutters=brep)
pt = Point([Point(-0.8000000119, -0.09188000113, 2.771017313), Point(-1.234145045, -0.09188000113, 2.095013142), Point(-0.306522429, -0.09188000113, 2.095013142)])
pt_2 = Point([Point(1.109120607, -0.09188000113, 1.231000781), Point(0.3065242171, -0.09188000113, 1.231000781), Point(0.3065242171, -0.09188000113, 0.4289836884), Point(1.109120607, -0.09188000113, 0.4289836884)])
pt_3 = Point([Point(0.8973990517, -0.09188000113, 2.742005804), Point(0.5924156742, -0.09188000113, 2.742005804), Point(0.4039232569, -0.09188000113, 2.561496237), Point(0.4039232569, -0.09188000113, 2.247879007), Point(0.5924156742, -0.09188000113, 2.066001632), Point(0.8973990517, -0.09188000113, 2.066001632), Point(1.085332318, -0.09188000113, 2.247879007), Point(1.085332318, -0.09188000113, 2.561496237)])
fixed_points = Point([Point(0.2455455512, -0.04886557907, 0.5516600013), Point(1.109120607, -0.05125979707, 0.5516600013), Point(1.109120607, -0.0427378118, 1.414644599), Point(-1.297619581, -0.09101001918, 2.032425165)])
pt_4 = Point()
pt_5 = Point([Point(0.3065242171, -0.01310251933, 1.600000024), Point(-0.306522429, -0.07775491476, 2.032425165)])
entwine = Entwine(Branch00=pt_3, Branch01=pt, Branch02=pt_2, FlattenInputs=True)
item = ListItem(List=pt_3, Index=0, Wrap=True)

lion_projected = Curve([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])
lion = Curve([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])

funnel_mantle = Surface(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)
funnel_polysrf = Brep(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)

starting_curves = Curve([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])
fixed_curves = Curve(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)
fixed_points_2 = Point([Point(0.2804844861, 0.4502441682, 1.029909887), Point(0.331432821, 1.017689574, 1.979141671), Point(-0.5452841738, 1.212971084, 2.218755462), Point(-0.7343416919, 0.2266228042, 1.58533129)])

mesh_data = Python3Script(surface=trim)  # -> mesh, rhino_mesh
# ---------- mesh_data: Python ----------
import Rhino
import numpy as np
import meshlib.mrmeshpy as mr
import rhinoscriptsyntax as rs
import Rhino.Geometry as rg
import trimesh as tr
import potpourri3d as pp3d
import importlib
import sys

import meshlib.mrmeshpy as mr
from meshlib.mrmeshpy import Vector3f, MeshBuilder
from meshlib.mrmeshpy import std_vector_std_array_Vector3_float_3 as VecOfTri
from meshlib.mrmeshpy import std_array_Vector3_float_3 as TriArray


import Rhino
import numpy as np
import meshlib.mrmeshpy as mr
import rhinoscriptsyntax as rs
import Rhino.Geometry as rg

# Append module path
module_path = r"C:\Users\merli\Documents\Projects\surface_filling_curves\src\modules"
if module_path not in sys.path:
    sys.path.append(module_path)
import cache_boundary_vertices_mod
import cache_principal_directions_mod
importlib.reload(cache_boundary_vertices_mod)
importlib.reload(cache_principal_directions_mod)
from cache_boundary_vertices_mod import cache_boundary_vertices
from cache_principal_directions_mod import cache_principal_directions

# INPUT: gh_surface — Rhino surface input from Grasshopper

# 1. Coerce to Brep
brep = rs.coercebrep(surface)
if brep and brep.IsValid:
    # Define custom meshing parameters
    mp = rg.MeshingParameters().Default
    #mp.GridQuads = False  # Disable quad generation
    #mp.RefineGrid = True
    #mp.SimplePlanes = False
    #mp.MinimumEdgeLength = 0.  # Adjust based on desired mesh density
    mp.MaximumEdgeLength = 0.1   # Adjust based on desired mesh density
    #mp.Tolerance = 0.01
    #mp.RelativeTolerance = 0.01

    # Generate mesh from Brep
    brep_meshes = rg.Mesh.CreateFromBrep(brep, mp)

    if brep_meshes:
        # Combine all sub-meshes into one
        mesh = rg.Mesh()
        for m in brep_meshes:
            mesh.Append(m)

        # Convert any remaining quads to triangles
        mesh.Faces.ConvertQuadsToTriangles()
        mesh.Normals.ComputeNormals()
        mesh.Compact()

rhino_mesh = mesh


# Convert Rhino mesh vertices and triangular faces to arrays
vertices = np.array([[v.X, v.Y, v.Z] for v in mesh.Vertices])
faces = np.array([[f.A, f.B, f.C] for f in mesh.Faces if f.IsTriangle])



V = np.array(vertices, dtype=np.float32)  # Shape: (n_vertices, 3)
F = np.array(faces, dtype=np.int32)

triangles = V[F]  # Shape: (n_faces, 3, 3)

tri_mesh = tr.Trimesh(vertices=V, faces=F, process=False)

_ = cache_boundary_vertices(tri_mesh)
_ = cache_principal_directions(tri_mesh)

posTriples = VecOfTri()

# Convert each triangular face into a TriArray
for face in faces:
    tri = TriArray()
    for i in range(3):
        v = vertices[face[i]]
        tri[i] = Vector3f(float(v[0]), float(v[1]), float(v[2]))
    posTriples.append(tri)


'''
# First the vertices
std_vector_Vector3_float_0 = mr.std_vector_Vector3_float

for i,v in enumerate(tri_mesh.vertices):
    Vector3f_0 = mr.Vector3f(float(v[0]), float(v[1]), float(v[2]))
    print(type(Vector3f_0))
    #std_vector_Vector3_float_0.__setitem__(i, Vector3f_0)
    std_vector_Vector3_float_0.append(Vector3f_0)

VertCoords_0 = mr.VertCoords.__init__(std_vector_Vector3_float_0)

# Now the triangles
std_vector_std_array_Id_VertTag_3_0 = mr.std_vector_std_array_Id_VertTag_3.__init__()

for triangle in tri_mesh.faces:

    std_array_Id_VertTag_3_0 = mr.std_array_Id_VertTag_3.__init__(*triangle)

    std_vector_std_array_Id_VertTag_3_0.append	(std_array_Id_VertTag_3_0)

Triangulation_0 = mr.Triangulation.__init__(std_vector_std_array_Id_VertTag_3_0)

'''

# Build the mesh
#meshlib_mesh = mr.Mesh.fromTriangles(VertCoords_0, Triangulation_0)
#meshlib_mesh = MeshBuilder.fromTriangles(VertCoords_0, Triangulation_0)
meshlib_mesh = MeshBuilder.fromPointTriples(posTriples)


#print(meshlib_mesh.points.vec)

def roughly_equal(a, b, tol=1e-6):
    return abs(a - b) == 0

dictionary = {}
for i, Vector3f_0 in enumerate(meshlib_mesh.points.vec):
    x0 = Vector3f_0.__getitem__(0)
    y0 = Vector3f_0.__getitem__(1)
    z0 = Vector3f_0.__getitem__(2)
    for j, vertex in enumerate(tri_mesh.vertices):
        x1 = vertex[0]
        y1 = vertex[1]
        z1 = vertex[2]
        
        if (roughly_equal(x0, x1) and roughly_equal(y0, y1) and roughly_equal(z0, z1)):
            dictionary[i] = j




# Build the solver

solver = mr.GeodesicPathApprox.DijkstraBiDir


V, F = tri_mesh.vertices, tri_mesh.faces
tracer = pp3d.GeodesicTracer(V, F)

#print('The version of pp3d is:',pp3d.__version__)

tri_mesh.heat = pp3d.MeshSignedHeatSolver(V, F)

pp3d_edges = pp3d.edges(V, F)

'''
for i, edge in enumerate(pp3d_edges):
    v1, v2 = edge
    _v1,_v2 = tri_mesh_edges[i]
    if set([v1, v2]) == set([_v1,_v2]):
        print('These are the same!')
    else:
        print('THese are not the same')
'''




#tri_mesh.pp3d_edges = pp3d.edges(V, F)


# Step 1: Normalize the pairs so order doesn't matter
normalized_edges = [tuple(sorted(e)) for e in pp3d_edges]

# Step 2 (fastest): Build a lookup dict once (ideal for many queries)
edge_index_map = {e: i for i, e in enumerate(normalized_edges)}
tri_mesh.pp3d_edges_index_map = edge_index_map

#print(tri_mesh.pp3d_edges)

mesh = [tri_mesh, meshlib_mesh, solver, tracer, dictionary]
# ---------- end mesh_data ----------
mesh = Mesh(mesh_data.rhino_mesh)

trace_geodesic = Python3Script(mesh=mesh_data.mesh, sp1=item)  # -> out, p1, p2, path; inputs mesh: list
# ---------- trace_geodesic: Python ----------
import importlib
import sys
import os
import Rhino.Geometry as rg
import rhinoscriptsyntax as rs
import importlib
import sys
import os
import Rhino.Geometry as rg
import numpy as np
# Append module path
module_path = r"C:\Users\merli\Documents\Projects\surface_filling_curves\src\modules"
if module_path not in sys.path:
    sys.path.append(module_path)

# Import all modules
import check_intersection_mod
import checkAdjacent_mod
import connect_surface_points_mod
import single_iteration_mod
import get_tangent_basis_mod
import medial_axis_mod
import point_point_geodesic_mod
import remesh_curve_on_surface_mod
import sharedFace_mod
import surface_filling_energy_geodesic_mod
import surface_path_evolution_mod
import surface_point_value_mod
import surface_point_vector_field_mod
import SurfacePoint_mod
import trace_geodesic_mod
import generate_surface_filling_curve_mod

# To reload after edits:
for mod_name in [
    check_intersection_mod, checkAdjacent_mod, connect_surface_points_mod,
    single_iteration_mod, get_tangent_basis_mod, medial_axis_mod,
    point_point_geodesic_mod, remesh_curve_on_surface_mod,
    sharedFace_mod, surface_filling_energy_geodesic_mod,
    surface_path_evolution_mod, surface_point_value_mod,
    surface_point_vector_field_mod, SurfacePoint_mod,
    trace_geodesic_mod, generate_surface_filling_curve_mod
]:
    importlib.reload(mod_name)


# Now bind the updated functions:
from surface_filling_energy_geodesic_mod import surface_filling_energy_geodesic
from surface_path_evolution_mod import surface_path_evolution
from single_iteration_mod import single_iteration
from medial_axis_mod import medial_axis
from SurfacePoint_mod import SurfacePoint
from generate_surface_filling_curve_mod import generate_surface_filling_curve
from trace_geodesic_mod import trace_geodesic
iteration = 0

# 0. UNPACKING THE GOODS

# from the mesh:
tri_mesh, meshlib_mesh, solver, tracer, dictionary = mesh



# from the mesh:
tri_mesh, meshlib_mesh, solver, tracer, dictionary = mesh

sp1 = rs.coerce3dpoint(sp1)




sp1 = SurfacePoint.from_position([sp1.X,sp1.Y,sp1.Z], tri_mesh, tolerance=1e-6)

p1 = rg.Point3d(*sp1.coord3d)

tol = 1e-6

direction = np.array((0.21, 0.1, 0.1))

res = trace_geodesic(tri_mesh, meshlib_mesh, sp1, direction, tracer, solver, dictionary, tol = 1e-6, use_point_point_geodesic = True)

path = []

for sp in res:
    path.append(rg.Point3d(*sp.coord3d))
    print(sp.type)
# ---------- end trace_geodesic ----------
panel = Panel(trace_geodesic.out)
geo = Geometry([trace_geodesic.path, trace_geodesic.p1, trace_geodesic.p2])

py3 = Python3Script()  # -> out, a
# ---------- py3: Python ----------
def find_connected_chains(segments):
    from collections import defaultdict, deque

    # Build adjacency map
    adjacency = defaultdict(list)
    for a, b in segments:
        adjacency[a].append(b)
        adjacency[b].append(a)

    visited = set()
    chains = []

    for node in adjacency:
        if node in visited:
            continue

        # Start a new chain
        chain = []
        queue = deque()
        queue.append(node)
        visited.add(node)

        while queue:
            current = queue.popleft()
            chain.append(current)
            for neighbor in adjacency[current]:
                if neighbor not in visited:
                    visited.add(neighbor)
                    queue.append(neighbor)

        # Sort the chain into an actual path (end-to-end order)
        # Find endpoints (nodes with only one neighbor)
        endpoints = [n for n in chain if len(adjacency[n]) == 1]
        if endpoints:
            # Start from one endpoint and reconstruct the path
            path = [endpoints[0]]
            seen = set(path)
            while len(path) < len(chain):
                current = path[-1]
                for neighbor in adjacency[current]:
                    if neighbor not in seen:
                        path.append(neighbor)
                        seen.add(neighbor)
                        break
            chains.append(path)
        else:
            # For loops or fully connected subgraphs (unlikely), just add unordered chain
            chains.append(chain)

    return chains

# Example usage
segments = [
    [1, 0],
    [2, 1],
    [2804, 2805],
    [2805, 2806],
    [2806, 2807],
    [2808, 2755],
    [2807, 2808],
]

chains = find_connected_chains(segments)
for i, chain in enumerate(chains):
    print(f"Chain {i+1}: {chain}")
# ---------- end py3 ----------
number_slider = Slider(5, range=0..5)

demesh = DeconstructMesh(Mesh=mesh_data.rhino_mesh)  # -> Vertices, Faces, Colours, Normals
pdecon = Deconstruct(Point=demesh.Vertices)  # -> XComponent, YComponent, ZComponent
py3_2 = Python3Script(z=pdecon.ZComponent)  # -> alphaRatioOnMesh; inputs z: list of Double
# ---------- py3_2: Python ----------
import numpy as np



arr = np.array(z, dtype=float)
xmin, xmax = arr.min(), arr.max()
y = 1 + (arr - xmin) / (xmax - xmin)
# If xmin == xmax, this gives nan; optionally handle constant list:
# y = np.ones_like(arr) if xmax == xmin else 1 + (arr - xmin)/(xmax - xmin)
# ---------- end py3_2 ----------

list = ValueList({"Laplacian-based interpolation": 1, "cotangent‐weighted Laplace–Beltrami interpolation": 2}, selected="Laplacian-based interpolation")
guiding_curves = Curve(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)
guiding_curves_2 = Curve(<curve referenced from the Rhino model>)
vectorfield_generation = Python3Script(
    interpolation_method=list,
    mesh=mesh_data.mesh,
    guiding_curves=guiding_curves_2,
    n_sample_points="300",
    reach_vectorfield=Slider(20, range=0..100))  # -> out, vector_field, VertexPoints, VertexTangents; inputs interpolation_method: Int32, mesh: list, guiding_curves: list, n_sample_points: Int32, reach_vectorfield: Int32
# ---------- vectorfield_generation: Python ----------
import numpy as np
import math
from scipy.sparse import coo_matrix, diags
from scipy.sparse.linalg import spsolve
import rhinoscriptsyntax as rs
import Rhino.Geometry as rg
import Grasshopper.Kernel.Types as ghtypes

tri_mesh = mesh[0]
V = tri_mesh.vertices
F = tri_mesh.faces
n_vertices = len(V)

# --- Common: Sample projected points and tangents from guiding curves ---
p_i, v_i, f_i = [], [], []
curves, curve_lengths = [], []
curves_total_length = 0.0

# Step 1: Coerce and measure all input curves
for curve_id in guiding_curves:
    try:
        curve = rs.coercecurve(curve_id)
    except:
        curve = getattr(curve_id, "Value", None)
    if not curve:
        continue
    curves.append(curve)
    length = curve.GetLength()
    curve_lengths.append(length)
    curves_total_length += length

# Step 2: Sample each curve and project its points + tangents to mesh
for j, curve in enumerate(curves):
    proportion = curve_lengths[j] / curves_total_length
    n = max(2, math.ceil(n_sample_points * proportion))
    domain = curve.Domain
    t_values = np.linspace(domain.T0, domain.T1, n)

    for t in t_values:
        pt = curve.PointAt(t)
        tan = curve.TangentAt(t)

        # Project point to mesh
        projected_pts, dists, face_ids = tri_mesh.nearest.on_surface([[pt.X, pt.Y, pt.Z]])
        projected = projected_pts[0]
        face_id = face_ids[0]

        # Project tangent to triangle plane
        tri = tri_mesh.faces[face_id]
        v0, v1, v2 = V[tri]
        tri_normal = np.cross(v1 - v0, v2 - v0)
        tri_normal /= np.linalg.norm(tri_normal)

        t_vec = np.array([tan.X, tan.Y, tan.Z])
        tan_proj = t_vec - np.dot(t_vec, tri_normal) * tri_normal

        p_i.append(projected)
        v_i.append(tan_proj)
        f_i.append(face_id)

# === METHOD 1: Laplacian-based interpolation (simple smoothing + barycentric weighting) ===
if interpolation_method == 1:
    accumulated = np.zeros((n_vertices, 3))
    weights = np.zeros(n_vertices)

    def barycentric_coords(p, tri):
        A = np.vstack((tri[1] - tri[0], tri[2] - tri[0])).T
        sol = np.linalg.lstsq(A, p - tri[0], rcond=None)[0]
        u, v = sol
        return np.array([1 - u - v, u, v])

    for pt, vec, fid in zip(p_i, v_i, f_i):
        tri = F[fid]
        bary = barycentric_coords(pt, V[tri])
        for k in range(3):
            vid = tri[k]
            accumulated[vid] += bary[k] * vec * 10
            weights[vid] += bary[k]

    nonzero = weights > 1e-8
    interpolated = np.zeros_like(accumulated)
    interpolated[nonzero] = accumulated[nonzero] / weights[nonzero, None]

    # Laplacian smoothing (1-ring average)
    smoothed = interpolated.copy()
    for i in range(n_vertices):
        neighbors = tri_mesh.vertex_neighbors[i]
        if neighbors: # if the vertex with index i has any neighbours
            expanded_neighbors = set(neighbors)

            for _ in range(reach_vectorfield):
                current_neighbors = list(expanded_neighbors)
                for element in current_neighbors:
                    expanded_neighbors.update(tri_mesh.vertex_neighbors[element])

            # Convert back to list if needed
            new_neighbors = list(expanded_neighbors)
            print(new_neighbors)

            smoothed[i] = 5 * interpolated[i] + 5 * interpolated[new_neighbors].mean(axis=0)

    field = smoothed

# === METHOD 2: Cotangent Laplace–Beltrami interpolation (global system solve) ===
elif interpolation_method == 2:

    def cotangent_laplacian(V, F):
        I, J, W = [], [], []
        areas = np.zeros(len(V))

        for tri in F:
            pts = V[tri]
            e0 = pts[1] - pts[0]
            e1 = pts[2] - pts[0]
            face_area = np.linalg.norm(np.cross(e0, e1)) * 0.5
            areas[tri] += face_area / 3

            for (i, j, k) in [(1, 2, 0), (2, 0, 1), (0, 1, 2)]:
                u = pts[j] - pts[k]
                v = pts[i] - pts[k]
                cot = np.dot(u, v) / np.linalg.norm(np.cross(u, v))
                I.extend([tri[i], tri[j]])
                J.extend([tri[j], tri[i]])
                W.extend([0.5 * cot, 0.5 * cot])

        C = coo_matrix((W, (I, J)), shape=(len(V), len(V))).tocsr()
        C.setdiag(-np.array(C.sum(axis=1)).flatten())
        M = diags(areas)
        return C, M

    C, M = cotangent_laplacian(V, F)
    lambda_param = 100.0  # controls smoothness vs fidelity
    A = M + lambda_param * C

    # Assign input data to nearest vertex (use simple KDTree from trimesh)
    v_data = np.zeros((n_vertices, 3))
    mask = np.zeros(n_vertices, dtype=bool)

    from scipy.spatial import cKDTree

    kdtree = cKDTree(V)  # V is your (n_vertices, 3) numpy array

    for pi, vi in zip(p_i, v_i):
        vid = kdtree.query(pi)[1]
        v_data[vid] = vi
        mask[vid] = True

    b = M @ v_data
    vx = spsolve(A, b[:, 0])
    vy = spsolve(A, b[:, 1])
    vz = spsolve(A, b[:, 2])
    field = np.vstack((vx, vy, vz)).T

# === Final: Project to tangent plane and output ===
normals = tri_mesh.vertex_normals
dotproj = np.einsum('ij,ij->i', field, normals)
tangent_field = field - dotproj[:, None] * normals

VertexPoints = [rg.Point3d(*v) for v in V]
VertexTangents = [rg.Vector3d(*v) for v in tangent_field]

vector_field = (V, tangent_field)

vector_field = np.array([tangent_field]).reshape(n_vertices, -1)
# ---------- end vectorfield_generation ----------
scale = Scale(Geometry=vectorfield_generation.VertexTangents, Center=Point(0, 0, 0), Factor=0.1)  # -> Geometry, Transform
vdisex = VectorDisplayEx(Point=vectorfield_generation.VertexPoints, Vector=scale.Geometry, Colour=RGB(0, 0, 0), Width=2)

vec = Vector([Vector(0, 0, 0), Vector(0, 0, 0), Vector(0, 0, 0), Vector(0, 0, 0), Vector(0, 0, 0), Vector(0, 0, 0)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])
vec_2 = Vector([Vector(1.600000024, -0.09188000113, 0), Vector(1.600000024, -0.06633231044, 0.05817713961), Vector(1.600000024, -0.04329815507, 0.1173917577), Vector(1.600000024, -0.0233373642, 0.179112345), Vector(1.600000024, -0.008621962741, 0.2396599501), Vector(1.600000024, 0.0005803728127, 0.3023806512)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])
number_slider_2 = Slider(10, range=0..10)
number_slider_3 = Slider(10, range=0..10)

curvature_energy_term = Python3Script(w_curvatureAlignedness=Slider(0, range=0..1))  # -> curvatureAlignedness_options; inputs w_curvatureAlignedness: Double
# ---------- curvature_energy_term: Python ----------
curvatureAlignedness_options = w_curvatureAlignedness
# ---------- end curvature_energy_term ----------

number_slider_4 = Slider(1, range=0..10)
vectorfield_align_energy_term = Python3Script(w_fieldAlignedness=Slider(0, range=0..1), vector_field=vectorfield_generation.vector_field)  # -> vector_field_options
# ---------- vectorfield_align_energy_term: Python ----------
"""Grasshopper Script"""
a = "Hello Python 3 in Grasshopper!"
print(a)


vector_field_options = [w_fieldAlignedness, vector_field]
# ---------- end vectorfield_align_energy_term ----------

list_2 = ValueList({"Use constant alpha": useConstantAlpha, "Use Anisotropic Alpha on Nodes": useAnisotropicAlphaOnNodes, "Use Anisotropic Alpha on Mesh": useAnisotropicAlphaOnMesh}, selected="Use constant alpha")
number_slider_5 = Slider(0.5, range=0..10)
medial_axis_energy_term = Python3Script(
    options=list_2,
    radius=number_slider_5,
    alphaRatioOnNodes=Slider(1, range=1..5),
    alphaRatioOnMesh=py3_2,
    q=Slider(2, range=1..5),
    maxRadius=Slider(3.551, range=0..10),
    h=Slider(0.05, range=0..10))  # -> out, medial_axis_options; inputs options: String, q: Double, maxRadius: Double, h: Double
# ---------- medial_axis_energy_term: Python ----------
# Packing the Goods

if options == 'useAnisotropicAlphaOnNodes': # THIS DOESNT HAVE TO BE EITHER OR;
    useAnisotropicAlphaOnMesh = False       #COULD ALSO USE BOTH AT THE SAME TIME (WITH WEIGHTS)
    useAnisotropicAlphaOnNodes = True

elif options == 'useAnisotropicAlphaOnMesh':
    useAnisotropicAlphaOnMesh = True
    useAnisotropicAlphaOnNodes = False

else:
    useAnisotropicAlphaOnNodes = False
    useAnisotropicAlphaOnMesh = False

    

medial_axis_options = [useAnisotropicAlphaOnNodes, useAnisotropicAlphaOnMesh, radius, alphaRatioOnNodes, alphaRatioOnMesh, q, maxRadius, h]
# ---------- end medial_axis_energy_term ----------

starting_curves_2 = Curve([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])
fixed_curves_2 = Curve([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])
fixed_points_3 = Point([Point(-0.2114466458, 0.4282833542, 0.7458690297), Point(-0.4504911908, 0.1626676506, 0.7565586867), Point(-0.4149220006, 0.3834252431, 1.147334226)])
panel_2 = Panel("0.03")
curve_data = Python3Script(mesh=mesh_data.mesh, starting_curves=entwine, fixed_points=pt_5, radius=number_slider_5)  # -> out, curves; inputs mesh: list, starting_curves: tree, fixed_points: list, radius: Double
# ---------- curve_data: Python ----------
# --- Module Imports & Setup ---

import importlib
import sys
import os
import numpy as np
import math
import rhinoscriptsyntax as rs
import Rhino
import meshlib.mrmeshpy as mr
import trimesh as tr
import Rhino.Geometry as rg

# Append module path
module_path = r"C:\Users\merli\Documents\Projects\surface_filling_curves\src\modules"
if module_path not in sys.path:
    sys.path.append(module_path)

# Import all modules
import check_intersection_mod
import checkAdjacent_mod
import connect_surface_points_mod
import single_iteration_mod
import get_tangent_basis_mod
import medial_axis_mod
import point_point_geodesic_mod
import remesh_curve_on_surface_mod
import sharedFace_mod
import surface_filling_energy_geodesic_mod
import surface_path_evolution_mod
import surface_point_value_mod
import surface_point_vector_field_mod
import SurfacePoint_mod
import trace_geodesic_mod
import process_curve_on_mesh_mod
import find_connected_chains_mod

# To reload after edits:
for mod_name in [
    check_intersection_mod, checkAdjacent_mod, connect_surface_points_mod,
    single_iteration_mod, get_tangent_basis_mod, medial_axis_mod,
    point_point_geodesic_mod, remesh_curve_on_surface_mod,
    sharedFace_mod, surface_filling_energy_geodesic_mod,
    surface_path_evolution_mod, surface_point_value_mod,
    surface_point_vector_field_mod, SurfacePoint_mod,
    trace_geodesic_mod, process_curve_on_mesh_mod,
    find_connected_chains_mod
    
]:
    importlib.reload(mod_name)


# Now bind the updated functions:
from surface_filling_energy_geodesic_mod import surface_filling_energy_geodesic
from surface_path_evolution_mod import surface_path_evolution
from single_iteration_mod import single_iteration
from medial_axis_mod import medial_axis
from SurfacePoint_mod import SurfacePoint
from connect_surface_points_mod import connect_surface_points
from process_curve_on_mesh_mod import process_curve_on_mesh
from find_connected_chains_mod import find_connected_chains
from remesh_curve_on_surface_mod import remesh_curve_on_surface



# --- INITIALIZATION ---

tri_mesh, meshlib_mesh, solver, tracer, dictionary = mesh

tol = 1e-6

# Prepare lists for nodes and segments
nodes = []
segments = []
segmentSurfacePoints = []
SegmentLengths = []
isFixedNode = []


# --- DEVELOPABLE CURVES PROCESSING ---

polylines = []
isFixedNode = []
points = []

for i in range(starting_curves.BranchCount):

    polyline = list(starting_curves.Branch(i))

    if not polyline:
        continue

    #print(polyline)

    rhino_pts = [rs.coerce3dpoint(pt) for pt in polyline]

    # Convert to a float array
    points_np = np.array([[pt.X, pt.Y, pt.Z] for pt in rhino_pts], dtype=float)  # shape (n,3)

    points.append(points_np)
    #curve = rs.coercecurve(curve_guid)

    #print(points_np)

    _, vertex_ids = tri_mesh._pq.vertex(points_np)



    polylines.append(vertex_ids)



if not fixed_points:
    isFixedNode = []
else:
    for _fixed_point in fixed_points:

        p = rs.coerce3dpoint(_fixed_point)
        if p is None:
            raise ValueError(f"Cannot convert how to Point3d: {_fixed_point}")

        coords = np.array([p.X, p.Y, p.Z], dtype=float)
        found = False
        
        # search which points_np contains it
        for i, points_np in enumerate(points):
            # mask of where coord matches within tolerance
            mask = np.all(np.isclose(points_np, coords), axis=1)
            if np.any(mask):
                j = np.where(mask)[0][0]
                vertex_index = polylines[i][j]
                isFixedNode.append(vertex_index)
                found = True

#print('polylines looks at first like this:',polylines)

# --- MESH EDGE PROCESSING ---
boundary_edges = tri_mesh.boundary_edges



boundary_vertices_indices = np.unique(boundary_edges.flatten())
#print('fixedNode looks liek this:',isFixedNode)
boundary_vertices_indices = [np.int64(vertex) for vertex in boundary_vertices_indices]
#print('boundary vertices looks liek this:',boundary_vertices_indices)
isFixedNode += boundary_vertices_indices

find_connected_chains(boundary_edges, polylines)
print(boundary_edges)

print('polylines looks now like this:',polylines)
print(len(polylines))

'''
#test_points = [rg.Point3d(*tri_mesh.vertices[idx]) for idx in boundary_vertices_indices]


for idx in boundary_vertices_indices:

    point = tri_mesh.vertices[idx]
    
    sp = SurfacePoint.from_position([point[0], point[1], point[2]], tri_mesh, tolerance=1e-6)

    nodes.append(sp)
    isFixedNode.append(True)
 

for _idx0, _idx1 in boundary_edges:
    idx0 = np.where(boundary_vertices_indices == _idx0)[0][0] + base
    idx1 = np.where(boundary_vertices_indices == _idx1)[0][0] + base
    segments.append([int(idx0), int(idx1)])
    # segmentSurfacePoints.append() # This is not necessary since its done later correctly anyway

'''


# --- PROCESS CURVE ON MESH ---
h = math.pi * radius / 25
nodes, segments, isFixedNode = process_curve_on_mesh(tri_mesh, polylines, isFixedNode)
segmentSurfacePoints, SegmentLengths = connect_surface_points(tri_mesh, meshlib_mesh, nodes, segments, solver, dictionary)
nodes, segments, segmentSurfacePoints, SegmentLengths, isFixedNode = remesh_curve_on_surface(tri_mesh, meshlib_mesh, nodes, segments, segmentSurfacePoints, SegmentLengths,isFixedNode, h, solver, dictionary)
assert len(segments) == len(segmentSurfacePoints), "Segment mismatch!"

# --- FINAL PACKING ---
curves = [nodes, segments, segmentSurfacePoints, SegmentLengths, isFixedNode]
# ---------- end curve_data ----------

shortest_curve_energy_term = Python3Script(p=Slider(1.124, range=0..5))  # -> shortest_curve_options; inputs p: Double
# ---------- shortest_curve_energy_term: Python ----------
shortest_curve_options = p
# ---------- end shortest_curve_energy_term ----------

biharmonic_energy_term = Python3Script(w_biharmonic=Slider(0, range=0..1))  # -> biharmonic_options; inputs w_biharmonic: Double
# ---------- biharmonic_energy_term: Python ----------
biharmonic_options = w_biharmonic
# ---------- end biharmonic_energy_term ----------

py3_3 = Python3Script(
    start=Toggle(True),
    n_iterations="1",
    mesh=mesh_data.mesh,
    curves=curve_data.curves,
    medial_axis_options=medial_axis_energy_term.medial_axis_options,
    biharmonic_options=biharmonic_energy_term,
    vector_field_options=vectorfield_align_energy_term,
    shortest_curve_options=shortest_curve_energy_term,
    curvatureAlignedness_options=curvature_energy_term)  # -> out, curve_iterations; inputs n_iterations: Int32, mesh: list, curves: list, medial_axis_options: list, vector_field_options: list
# ---------- py3_3: Python ----------
import importlib
import sys
import os
import Rhino.Geometry as rg

# Append module path
module_path = r"C:\Users\merli\Documents\Projects\surface_filling_curves\src\modules"
if module_path not in sys.path:
    sys.path.append(module_path)

# Import all modules
import check_intersection_mod
import checkAdjacent_mod
import connect_surface_points_mod
import single_iteration_mod
import get_tangent_basis_mod
import medial_axis_mod
import point_point_geodesic_mod
import remesh_curve_on_surface_mod
import sharedFace_mod
import surface_filling_energy_geodesic_mod
import surface_path_evolution_mod
import surface_point_value_mod
import surface_point_vector_field_mod
import SurfacePoint_mod
import trace_geodesic_mod
import generate_surface_filling_curve_mod

# To reload after edits:
for mod_name in [
    check_intersection_mod, checkAdjacent_mod, connect_surface_points_mod,
    single_iteration_mod, get_tangent_basis_mod, medial_axis_mod,
    point_point_geodesic_mod, remesh_curve_on_surface_mod,
    sharedFace_mod, surface_filling_energy_geodesic_mod,
    surface_path_evolution_mod, surface_point_value_mod,
    surface_point_vector_field_mod, SurfacePoint_mod,
    trace_geodesic_mod, generate_surface_filling_curve_mod
]:
    importlib.reload(mod_name)


# Now bind the updated functions:
from surface_filling_energy_geodesic_mod import surface_filling_energy_geodesic
from surface_path_evolution_mod import surface_path_evolution
from single_iteration_mod import single_iteration
from medial_axis_mod import medial_axis
from SurfacePoint_mod import SurfacePoint
from generate_surface_filling_curve_mod import generate_surface_filling_curve

iteration = 0

# 0. UNPACKING THE GOODS

# from the mesh:
tri_mesh, meshlib_mesh, solver, tracer, dictionary = mesh


# from the curves:
nodes, segments, segmentSurfacePoints, segmentLengths, isFixedNode = curves 

# from the medial_axis_options:
useAnisotropicAlphaOnNodes, useAnisotropicAlphaOnMesh, radius, alphaRatioOnNodes, alphaRatioOnMesh, q, maxRadius, h = medial_axis_options

# from the vectorfield:
w_fieldAlignedness, vector_field = vector_field_options

# from the shortest curve term:
p = shortest_curve_options

# from the biharmonic term:
w_biharmonic = biharmonic_options

# from the curvature alignedness energy term
w_curvatureAlignedness = curvatureAlignedness_options

# NOW RUN THE ALGORITHM

if start:
    curve_iterations = generate_surface_filling_curve(n_iterations, nodes, segments, segmentSurfacePoints, segmentLengths, isFixedNode,
            tri_mesh, meshlib_mesh, solver, tracer, dictionary,
            vector_field,
            maxRadius, radius, h,
            useAnisotropicAlphaOnNodes, useAnisotropicAlphaOnMesh,
            alphaRatioOnNodes, alphaRatioOnMesh,
            w_fieldAlignedness, w_curvatureAlignedness, w_biharmonic,
            p, q
        )
# ---------- end py3_3 ----------
py3_4 = Python3Script(curve_iterations=["Grasshopper.Kernel.Types.GH_ObjectWrapper", "Grasshopper.Kernel.Types.GH_ObjectWrapper", "Grasshopper.Kernel.Types.GH_ObjectWrapper", "Grasshopper.Kernel.Types.GH_ObjectWrapper", "Grasshopper.Kernel.Types.GH_ObjectWrapper", "Grasshopper.Kernel.Types.GH_ObjectWrapper", "Grasshopper.Kernel.Types.GH_ObjectWrapper", "Grasshopper.Kernel.Types.GH_ObjectWrapper", "Grasshopper.Kernel.Types.GH_ObjectWrapper", "Grasshopper.Kernel.Types.GH_ObjectWrapper", "Grasshopper.Kernel.Types.GH_ObjectWrapper"])  # -> out, curve_iterations
# ---------- py3_4: Python ----------
_curve_iterations = curve_iterations
# ---------- end py3_4 ----------
py3_5 = Python3Script(curve_iterations=["Grasshopper.Kernel.Types.GH_ObjectWrapper", "Grasshopper.Kernel.Types.GH_ObjectWrapper", "Grasshopper.Kernel.Types.GH_ObjectWrapper", "Grasshopper.Kernel.Types.GH_ObjectWrapper", "Grasshopper.Kernel.Types.GH_ObjectWrapper", "Grasshopper.Kernel.Types.GH_ObjectWrapper", "Grasshopper.Kernel.Types.GH_ObjectWrapper", "Grasshopper.Kernel.Types.GH_ObjectWrapper", "Grasshopper.Kernel.Types.GH_ObjectWrapper", "Grasshopper.Kernel.Types.GH_ObjectWrapper", "Grasshopper.Kernel.Types.GH_ObjectWrapper", "Grasshopper.Kernel.Types.GH_ObjectWrapper", "Grasshopper.Kernel.Types.GH_ObjectWrapper", "Grasshopper.Kernel.Types.GH_ObjectWrapper", "Grasshopper.Kernel.Types.GH_ObjectWrapper", "Grasshopper.Kernel.Types.GH_ObjectWrapper", "Grasshopper.Kernel.Types.GH_ObjectWrapper", "Grasshopper.Kernel.Types.GH_ObjectWrapper", "Grasshopper.Kernel.Types.GH_ObjectWrapper", "Grasshopper.Kernel.Types.GH_ObjectWrapper", "Grasshopper.Kernel.Types.GH_ObjectWrapper", "Grasshopper.Kernel.Types.GH_ObjectWrapper", "Grasshopper.Kernel.Types.GH_ObjectWrapper", "Grasshopper.Kernel.Types.GH_ObjectWrapper", "Grasshopper.Kernel.Types.GH_ObjectWrapper", "Grasshopper.Kernel.Types.GH_ObjectWrapper"])  # -> out, curve_iterations; same code as py3_4
number_slider_6 = Slider(1, range=0..10)
number_slider_7 = Slider(35, range=0..1000)
visualization = Python3Script(curve_iterations=py3_3.curve_iterations, iteration=Slider(1, range=0..100))  # -> out, nodes, curves, descent, medial_axis; inputs curve_iterations: list, iteration: Int32
# ---------- visualization: Python ----------
import Rhino.Geometry as rg

if iteration >= len(curve_iterations)- 1:
    new_iteration = curve_iterations[-1]

    new_iter = new_iteration["iteration"]
    new_nodes = new_iteration["nodes"]
    new_segments = new_iteration["segments"]
    new_segmentSurfacePoints = new_iteration["segmentSurfacePoints"]
    new_segmentLengths = new_iteration["segmentLengths"]
    new_d = new_iteration["descent"]
    new_medialAxis = new_iteration["medialAxis"]


else:
    new_iteration = curve_iterations[iteration]

    new_iter = new_iteration["iteration"]
    new_nodes = new_iteration["nodes"]
    new_segments = new_iteration["segments"]
    new_segmentSurfacePoints = new_iteration["segmentSurfacePoints"]
    new_segmentLengths = new_iteration["segmentLengths"]
    new_d = curve_iterations[iteration + 1]["descent"]
    new_medialAxis = curve_iterations[iteration + 1]["medialAxis"]


print(f"\n--- Surface Curve Evolution Progress ---")
print(f"Current iteration number: {new_iter}")
print(f"Total length all curves: {sum(new_segmentLengths):.3f} units")
print(f"-----------------------------------------\n")

nodes = [rg.Point3d(*sp.coord3d) for sp in new_nodes]

curves = []
for j, seg in enumerate(new_segments):
    path = [nodes[seg[0]]]
    #path = []
    for sp in new_segmentSurfacePoints[j]:
        path.append(rg.Point3d(*sp.coord3d))
        #print(rg.Point3d(*sp.coord3d))
    path.append(nodes[seg[1]])  # Fix: not a list
    polyline = rg.PolylineCurve(rg.Polyline(path))
    #print(polyline)
    #segments.append(path)
    curves.append(polyline)

print('This is the medial axis',new_medialAxis)


if new_d:
    descent = []
    for vector in new_d:
        if vector is not None:
            descent.append(rg.Point3d(vector[0], vector[1], vector[2]))
        else:
            descent.append(rg.Point3d(0.0, 0.0, 0.0))

medial_axis_left = []
medial_axis_right = []

for pair in new_medialAxis:
    medial_axis_left.append(rg.Point3d(*pair[0]))
    medial_axis_right.append(rg.Point3d(*pair[1]))

medial_axis = [pt for pair in zip(medial_axis_left, medial_axis_right) for pt in pair]
# ---------- end visualization ----------
crv = Curve([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])
addition = Addition(A=number_slider_7, B=1)
crv_2 = Curve(visualization.curves)
pt_6 = Point(visualization.nodes)
pt_7 = Point(visualization.medial_axis)
item_2 = ListItem(List=visualization.medial_axis, Index=[number_slider_7, addition], Wrap=True)
item_3 = ListItem(List=visualization.nodes, Index=number_slider_7, Wrap=True)
pt_8 = Point([item_2, item_3])
scale_2 = Scale(Geometry=visualization.descent, Center=Point(0, 0, 0), Factor=0.1)  # -> Geometry, Transform
vdis = VectorDisplay(Anchor=visualization.nodes, Vector=scale_2.Geometry)
panel_3 = Panel(visualization.out)
