# Grasshopper definition BA_main_3_intermediary.gh (Grasshopper 1.0.8)

multiplication = Multiplication(A=Slider(4, range=0..100), B=2)
vec = VectorXYZ(XComponent=Slider(20, range=0..100), YComponent=0, ZComponent=0)  # -> Vector, Length
addition = Addition(A=multiplication, B=1)
pt = ConstructPoint(XCoordinate=0, YCoordinate=0, ZCoordinate=0)
arrlinear = LinearArray(Geometry=pt, Direction=vec.Vector, Count=addition)  # -> Geometry, Transform
series = Series(Start=0, Step=vec.Vector, Count=addition)
Y = UnitY(Factor=series)
move = Move(Geometry=arrlinear.Geometry, Motion=graft(Y))  # -> Geometry, Transform
sort_pt = SortPoints(Points=flatten(move.Geometry))  # -> Points, Indices
dispatch = Dispatch(List=flatten(sort_pt.Points), DispatchPattern=[True, False])  # -> ListA, ListB
xz = XZPlane(Origin=Point(0, 0, 0))
Z = UnitZ(Factor=Slider(4.594, range=0..10))
move_2 = Move(Geometry=dispatch.ListA, Motion=Z)  # -> Geometry, Transform
geo = Geometry([move_2.Geometry, dispatch.ListB])
sort_pt_2 = SortPoints(Points=geo)  # -> Points, Indices
pdecon = Deconstruct(Point=sort_pt_2.Points)  # -> XComponent, YComponent, ZComponent
partition = PartitionList(List=sort_pt_2.Points, Size=9)
intcrv_t = InterpolateT(Vertices=partition, TangentStart=Vector(0, 0, 0), TangentEnd=Vector(0, 0, 0), KnotStyle=1)  # -> flatten(Curve), Length, Domain
sort = SortList(Keys=pdecon.YComponent, ValuesA=sort_pt_2.Points)  # -> Keys, ValuesA
srfgrid = SurfaceFromPoints(Points=sort_pt_2.Points, UCount=addition, Interpolate=False)  # disabled
partition_2 = PartitionList(List=sort.ValuesA, Size=9)
pdecon_2 = Deconstruct(Point=partition_2)  # -> XComponent, YComponent, ZComponent
sort_2 = SortList(Keys=pdecon_2.XComponent, ValuesA=partition_2)  # -> Keys, ValuesA
intcrv_t_2 = InterpolateT(Vertices=sort_2.ValuesA, TangentStart=Vector(0, 0, 0), TangentEnd=Vector(0, 0, 0), KnotStyle=1)  # -> flatten(Curve), Length, Domain
netsurf = NetworkSurface(CurvesU=intcrv_t.Curve, CurvesV=intcrv_t_2.Curve, Continuity=2)
rotate = Rotate(Geometry=netsurf, Angle=1.570796327, Plane=xz)  # -> Geometry, Transform
number_slider = Slider(10, range=0..10)
rotate_2 = Rotate(Geometry=rotate.Geometry, Angle=1.570796327, Plane=PlaneXY(0, 0, 0))  # -> Geometry, Transform
X = UnitX(Factor=Slider(80, range=0..100))
move_3 = Move(Geometry=rotate_2.Geometry, Motion=X)  # -> Geometry, Transform
scale = Scale(Geometry=move_3.Geometry, Center=Point(0, 0, 0), Factor=0.02)  # -> Geometry, Transform

starting_curves = Curve(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)
fixed_curves = Curve([<curve referenced from the Rhino model> x2])
fixed_points = Point([Point(0.2804844861, 0.4502441682, 1.029909887), Point(0.331432821, 1.017689574, 1.979141671), Point(-0.5452841738, 1.212971084, 2.218755462), Point(-0.7343416919, 0.2266228042, 1.58533129)])

lion_projected = Curve([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])
lion = Curve([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])

funnel_mantle = Surface(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)
funnel_polysrf = Brep(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)

starting_curves_2 = Curve([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])
fixed_curves_2 = Curve(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)
fixed_points_2 = Point([Point(0.2804844861, 0.4502441682, 1.029909887), Point(0.331432821, 1.017689574, 1.979141671), Point(-0.5452841738, 1.212971084, 2.218755462), Point(-0.7343416919, 0.2266228042, 1.58533129)])

mesh_data = Python3Script(surface=scale.Geometry)  # -> mesh, rhino_mesh
# ---------- mesh_data: Python ----------
import Rhino
import numpy as np
import meshlib.mrmeshpy as mr
import rhinoscriptsyntax as rs
import Rhino.Geometry as rg
import trimesh as tr
import potpourri3d as pp3d
import importlib
import sys

import meshlib.mrmeshpy as mr
from meshlib.mrmeshpy import Vector3f, MeshBuilder
from meshlib.mrmeshpy import std_vector_std_array_Vector3_float_3 as VecOfTri
from meshlib.mrmeshpy import std_array_Vector3_float_3 as TriArray


import Rhino
import numpy as np
import meshlib.mrmeshpy as mr
import rhinoscriptsyntax as rs
import Rhino.Geometry as rg

# Append module path
module_path = r"C:\Users\merli\Documents\Projects\surface_filling_curves\src\modules"
if module_path not in sys.path:
    sys.path.append(module_path)
import cache_boundary_vertices_mod
import cache_principal_directions_mod
importlib.reload(cache_boundary_vertices_mod)
importlib.reload(cache_principal_directions_mod)
from cache_boundary_vertices_mod import cache_boundary_vertices
from cache_principal_directions_mod import cache_principal_directions

# INPUT: gh_surface — Rhino surface input from Grasshopper

# 1. Coerce to Brep
brep = rs.coercebrep(surface)
if brep and brep.IsValid:
    # Define custom meshing parameters
    mp = rg.MeshingParameters().Default
    #mp.GridQuads = False  # Disable quad generation
    #mp.RefineGrid = True
    #mp.SimplePlanes = False
    #mp.MinimumEdgeLength = 0.01  # Adjust based on desired mesh density
    mp.MaximumEdgeLength = 0.2   # Adjust based on desired mesh density
    #mp.Tolerance = 0.01
    #mp.RelativeTolerance = 0.01

    # Generate mesh from Brep
    brep_meshes = rg.Mesh.CreateFromBrep(brep, mp)

    if brep_meshes:
        # Combine all sub-meshes into one
        mesh = rg.Mesh()
        for m in brep_meshes:
            mesh.Append(m)

        # Convert any remaining quads to triangles
        mesh.Faces.ConvertQuadsToTriangles()
        mesh.Normals.ComputeNormals()
        mesh.Compact()

rhino_mesh = mesh


# Convert Rhino mesh vertices and triangular faces to arrays
vertices = np.array([[v.X, v.Y, v.Z] for v in mesh.Vertices])
faces = np.array([[f.A, f.B, f.C] for f in mesh.Faces if f.IsTriangle])



V = np.array(vertices, dtype=np.float32)  # Shape: (n_vertices, 3)
F = np.array(faces, dtype=np.int32)

triangles = V[F]  # Shape: (n_faces, 3, 3)

tri_mesh = tr.Trimesh(vertices=V, faces=F, process=False)

_ = cache_boundary_vertices(tri_mesh)
_ = cache_principal_directions(tri_mesh)

posTriples = VecOfTri()

# Convert each triangular face into a TriArray
for face in faces:
    tri = TriArray()
    for i in range(3):
        v = vertices[face[i]]
        tri[i] = Vector3f(float(v[0]), float(v[1]), float(v[2]))
    posTriples.append(tri)


'''
# First the vertices
std_vector_Vector3_float_0 = mr.std_vector_Vector3_float

for i,v in enumerate(tri_mesh.vertices):
    Vector3f_0 = mr.Vector3f(float(v[0]), float(v[1]), float(v[2]))
    print(type(Vector3f_0))
    #std_vector_Vector3_float_0.__setitem__(i, Vector3f_0)
    std_vector_Vector3_float_0.append(Vector3f_0)

VertCoords_0 = mr.VertCoords.__init__(std_vector_Vector3_float_0)

# Now the triangles
std_vector_std_array_Id_VertTag_3_0 = mr.std_vector_std_array_Id_VertTag_3.__init__()

for triangle in tri_mesh.faces:

    std_array_Id_VertTag_3_0 = mr.std_array_Id_VertTag_3.__init__(*triangle)

    std_vector_std_array_Id_VertTag_3_0.append	(std_array_Id_VertTag_3_0)

Triangulation_0 = mr.Triangulation.__init__(std_vector_std_array_Id_VertTag_3_0)

'''

# Build the mesh
#meshlib_mesh = mr.Mesh.fromTriangles(VertCoords_0, Triangulation_0)
#meshlib_mesh = MeshBuilder.fromTriangles(VertCoords_0, Triangulation_0)
meshlib_mesh = MeshBuilder.fromPointTriples(posTriples)


print(meshlib_mesh.points.vec)

def roughly_equal(a, b, tol=1e-6):
    return abs(a - b) == 0

dictionary = {}
for i, Vector3f_0 in enumerate(meshlib_mesh.points.vec):
    x0 = Vector3f_0.__getitem__(0)
    y0 = Vector3f_0.__getitem__(1)
    z0 = Vector3f_0.__getitem__(2)
    for j, vertex in enumerate(tri_mesh.vertices):
        x1 = vertex[0]
        y1 = vertex[1]
        z1 = vertex[2]
        
        if (roughly_equal(x0, x1) and roughly_equal(y0, y1) and roughly_equal(z0, z1)):
            dictionary[i] = j




# Build the solver

solver = mr.GeodesicPathApprox.DijkstraBiDir


V, F = tri_mesh.vertices, tri_mesh.faces
tracer = pp3d.GeodesicTracer(V, F)

mesh = [tri_mesh, meshlib_mesh, solver, tracer, dictionary]

print(type(solver))
# ---------- end mesh_data ----------
mesh = Mesh(mesh_data.rhino_mesh)

# ----
# Initial preparation of developable and fixed curves.
# 
# This "fixed_curves" here is used for curves
# that you dont want to evolve,
# but still be part of the final image.
starting_curves_3 = Curve([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])
fixed_curves_3 = Curve([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])
fixed_points_3 = Point([Point(-0.2114466458, 0.4282833542, 0.7458690297), Point(-0.4504911908, 0.1626676506, 0.7565586867), Point(-0.4149220006, 0.3834252431, 1.147334226)])
curve_data = Python3Script(
    mesh=mesh_data.mesh,
    starting_curves=starting_curves,
    fixed_points=fixed_points,
    fixed_curves=fixed_curves,
    segment_length="0.1")  # -> out, curves; inputs mesh: list, starting_curves: list, fixed_points: list, fixed_curves: list, segment_length: Double
# ---------- curve_data: Python ----------
# --- Module Imports & Setup ---

import importlib
import sys
import os
import numpy as np
import math
import rhinoscriptsyntax as rs
import Rhino
import meshlib.mrmeshpy as mr
import trimesh as tr
import Rhino.Geometry as rg

# Append module path
module_path = r"C:\Users\merli\Documents\Projects\surface_filling_curves\src\modules"
if module_path not in sys.path:
    sys.path.append(module_path)

# Import all modules
import check_intersection_mod
import checkAdjacent_mod
import connect_surface_points_mod
import single_iteration_mod
import get_tangent_basis_mod
import medial_axis_mod
import point_point_geodesic_mod
import remesh_curve_on_surface_mod
import sharedFace_mod
import surface_filling_energy_geodesic_mod
import surface_path_evolution_mod
import surface_point_value_mod
import surface_point_vector_field_mod
import SurfacePoint_mod
import trace_geodesic_mod

# To reload after edits:
for mod_name in [
    check_intersection_mod, checkAdjacent_mod, connect_surface_points_mod,
    single_iteration_mod, get_tangent_basis_mod, medial_axis_mod,
    point_point_geodesic_mod, remesh_curve_on_surface_mod,
    sharedFace_mod, surface_filling_energy_geodesic_mod,
    surface_path_evolution_mod, surface_point_value_mod,
    surface_point_vector_field_mod, SurfacePoint_mod,
    trace_geodesic_mod
]:
    importlib.reload(mod_name)


# Now bind the updated functions:
from surface_filling_energy_geodesic_mod import surface_filling_energy_geodesic
from surface_path_evolution_mod import surface_path_evolution
from single_iteration_mod import single_iteration
from medial_axis_mod import medial_axis
from SurfacePoint_mod import SurfacePoint
from connect_surface_points_mod import connect_surface_points



# --- Initialization ---

tri_mesh, meshlib_mesh, solver, tracer, dictionary = mesh

length = segment_length  # Resolution, 10 works well in the example
tol = 1e-6

# Prepare lists for nodes and segments
nodes = []
segments = []
segmentSurfacePoints = []
SegmentLengths = []
isFixedNode = []


# --- DEVELOPABLE CURVES PROCESSING ---

for curve_guid in starting_curves:
    curve = rs.coercecurve(curve_guid)
    if not curve:
        continue

    if curve.GetLength() < length:
        if curve.IsClosed:
            continue

        t_vals_loose = []
        t_vals_fixed = []

        if len(fixed_points) != 0:
            for pt in fixed_points:
                pt = rs.coerce3dpoint(pt)
                t, _ = curve.ClosestPoint(pt)
                cp = curve.PointAt(t)
                if cp.DistanceTo(pt) <= tol:
                    t_vals_fixed.append((t, True))

        t_vals_loose = [(0, False), (1, False)]
        combined = sorted(t_vals_loose + t_vals_fixed, key=lambda x: x[0])

        deduped = {}
        for t, is_fixed in combined:
            if t not in deduped or is_fixed:
                deduped[t] = is_fixed

        t_vals = sorted(deduped.items(), key=lambda x: x[0])
        points = [curve.PointAt(t) for t, _ in t_vals]
        _isFixedNode = [b for _, b in t_vals]
        isFixedNode += _isFixedNode

        base_index = len(nodes)
        for j, point in enumerate(points):
            sp = SurfacePoint.from_position([point.X, point.Y, point.Z], tri_mesh, tolerance=1e-6)
            nodes.append(sp)

            if j < len(points) - 1:
                segments.append([base_index + j, base_index + j + 1])
            elif curve.IsClosed:
                segments.append([base_index + j, base_index + 0])

    else:
        t_vals_loose = []
        t_vals_fixed = []

        if len(fixed_points) != 0:
            for pt in fixed_points:
                pt = rs.coerce3dpoint(pt)
                t, _ = curve.ClosestPoint(pt)
                cp = curve.PointAt(t)
                if cp.DistanceTo(pt) <= tol:
                    t_vals_fixed.append((t, True))

        start_t = curve.Domain[0]
        end_t = curve.Domain[1]
        t_divided = curve.DivideByLength(length, includeEnds=False)
        t_vals_loose = [(start_t, False)] + [(t, False) for t in t_divided] + [(end_t, False)]

        if curve.IsClosed:
            t_vals_loose.pop()

        combined = sorted(t_vals_loose + t_vals_fixed, key=lambda x: x[0])

        deduped = {}
        for t, is_fixed in combined:
            if t not in deduped or is_fixed:
                deduped[t] = is_fixed

        t_vals = sorted(deduped.items(), key=lambda x: x[0])
        points = [curve.PointAt(t) for t, _ in t_vals]
        _isFixedNode = [b for _, b in t_vals]
        isFixedNode += _isFixedNode

        base_index = len(nodes)
        for j, point in enumerate(points):
            sp = SurfacePoint.from_position([point.X, point.Y, point.Z], tri_mesh, tolerance=1e-6)
            nodes.append(sp)

            if j < len(points) - 1:
                segments.append([base_index + j, base_index + j + 1])
            elif curve.IsClosed:
                segments.append([base_index + j, base_index + 0])


# --- FIXED CURVES PROCESSING ---

for curve_guid in fixed_curves:
    #print(type(curve_guid))
    curve = rs.coercecurve(curve_guid)
    if not curve:
        continue

    if curve.GetLength() < length:
        continue

    t_vals_loose = []
    t_vals_fixed = []

    if len(fixed_points) != 0:
        for pt in fixed_points:
            pt = rs.coerce3dpoint(pt)
            t, _ = curve.ClosestPoint(pt)
            cp = curve.PointAt(t)
            if cp.DistanceTo(pt) <= tol:
                t_vals_fixed.append((t, True))

    start_t = curve.Domain[0]
    end_t = curve.Domain[1]
    t_divided = curve.DivideByLength(length, includeEnds=False)
    t_vals_loose = [(start_t, False)] + [(t, False) for t in t_divided] + [(end_t, False)]

    if curve.IsClosed:
        t_vals_loose.pop()

    t_vals = sorted(t_vals_loose + t_vals_fixed, key=lambda x: x[0])
    points = [curve.PointAt(t) for t, _ in t_vals]
    _isFixedNode = [b for _, b in t_vals]
    isFixedNode += _isFixedNode

    base_index = len(nodes)
    for j, point in enumerate(points):
        sp = SurfacePoint.from_position([point.X, point.Y, point.Z], tri_mesh, tolerance=1e-6)
        nodes.append(sp)

        if j < len(points) - 1:
            segments.append([base_index + j, base_index + j + 1])
        elif curve.IsClosed:
            segments.append([base_index + j, base_index + 0])


'''
# --- MESH EDGE HANDLING  ---

base = len(nodes)

boundary_edges = tri_mesh.boundary_edges

#print('The boundary edges are:', boundary_edges)

boundary_vertices_indices = np.unique(boundary_edges.flatten())

#test_points = [rg.Point3d(*tri_mesh.vertices[idx]) for idx in boundary_vertices_indices]


for idx in boundary_vertices_indices:

    point = tri_mesh.vertices[idx]
    
    sp = SurfacePoint.from_position([point[0], point[1], point[2]], tri_mesh, tolerance=1e-6)

    nodes.append(sp)
    isFixedNode.append(True)
 

for _idx0, _idx1 in boundary_edges:
    idx0 = np.where(boundary_vertices_indices == _idx0)[0][0] + base
    idx1 = np.where(boundary_vertices_indices == _idx1)[0][0] + base
    segments.append([int(idx0), int(idx1)])
    # segmentSurfacePoints.append() # This is not necessary since its done later correctly anyway

print('CHECK ----------------------------------------------')
print('THe nodes:',nodes)
print('The segments:',segments)
print('The booleans:',isFixedNode)
'''

# --- DUPLICATE CHECK AND CONNECTION ---

def has_duplicates_ndarray(lst):
    seen = set()
    for item in lst:
        t = tuple(item.tolist())
        if t in seen:
            return True
        seen.add(t)
    return False

print('-----------------')
a = [sp.coord3d for sp in nodes]
if has_duplicates_ndarray(a):
    print("Duplicates found!")
else:
    print("No duplicates")
#print(segments, a)
print('-----------------')

a = [rg.Point3d(*sp.coord3d) for sp in nodes]
# Connect surface points
segmentSurfacePoints, SegmentLengths = connect_surface_points(
    tri_mesh, meshlib_mesh, nodes, segments, solver, dictionary
)
assert len(segments) == len(segmentSurfacePoints), "Segment mismatch!"



# --- FINAL PACKING ---

curves = [nodes, segments, segmentSurfacePoints, SegmentLengths, isFixedNode]
# ---------- end curve_data ----------

pt_2 = Point(Point(0, -0.03761511669, 2.646466732))
pt_3 = Point(Point(0, -0.05590078235, 2.590507746))
test_sharedface = Python3Script(mesh=mesh_data.mesh, sp1=pt_2, sp2=pt_3)  # -> out, p1, p2, surf; inputs mesh: list
# ---------- test_sharedface: Python ----------
import importlib
import sys
import os
import Rhino.Geometry as rg
import rhinoscriptsyntax as rs

# Append module path
module_path = r"C:\Users\merli\Documents\Projects\surface_filling_curves\src\modules"
if module_path not in sys.path:
    sys.path.append(module_path)

# Import all modules
import check_intersection_mod
import checkAdjacent_mod
import connect_surface_points_mod
#import doWork_mod
import get_tangent_basis_mod
import medial_axis_mod
import point_point_geodesic_mod
import remesh_curve_on_surface_mod
import sharedFace_mod
import surface_filling_energy_geodesic_mod
#import surface_path_evolution_mod
import surface_point_value_mod
import surface_point_vector_field_mod
import SurfacePoint_mod
import trace_geodesic_mod

# To reload after edits:
for mod_name in [
    check_intersection_mod, checkAdjacent_mod, connect_surface_points_mod, get_tangent_basis_mod, medial_axis_mod,
    point_point_geodesic_mod, remesh_curve_on_surface_mod,
    sharedFace_mod, surface_filling_energy_geodesic_mod, surface_point_value_mod,
    surface_point_vector_field_mod, SurfacePoint_mod,
    trace_geodesic_mod
]:
    importlib.reload(mod_name)


# Now bind the updated functions:
from surface_filling_energy_geodesic_mod import surface_filling_energy_geodesic


from medial_axis_mod import medial_axis
from SurfacePoint_mod import SurfacePoint
from sharedFace_mod import sharedFace


# from the mesh:
tri_mesh, meshlib_mesh, solver, tracer = mesh

sp1 = rs.coerce3dpoint(sp1)
sp2 = rs.coerce3dpoint(sp2)


sp1 = SurfacePoint.from_position([sp1.X,sp1.Y,sp1.Z], tri_mesh, tolerance=1e-6)
sp2 = SurfacePoint.from_position([sp2.X,sp2.Y,sp2.Z], tri_mesh, tolerance=1e-6)

p1 = rg.Point3d(*sp1.coord3d)
p2 = rg.Point3d(*sp2.coord3d)

x = sharedFace(sp1,sp2,tri_mesh) 

if x == -1:
    print('These points dont share a face!')
else:
    triangle = [tri_mesh.vertices[i] for i in tri_mesh.faces[x]]

    ptA, ptB, ptC = rg.Point3d(*triangle[0]), rg.Point3d(*triangle[1]), rg.Point3d(*triangle[2])

    surf = rg.NurbsSurface.CreateFromCorners(ptA, ptB, ptC)
# ---------- end test_sharedface ----------
panel = Panel(test_sharedface.out)
geo_2 = Geometry([test_sharedface.surf, test_sharedface.p1, test_sharedface.p2])  # disabled

list = ValueList({"Laplacian-based interpolation": 1, "cotangent‐weighted Laplace–Beltrami interpolation": 2}, selected="Laplacian-based interpolation")
guiding_curves = Curve(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)
guiding_curves_2 = Curve(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)
vectorfield_generation = Python3Script(interpolation_method=list, mesh=mesh_data.mesh, guiding_curves=guiding_curves_2, n_sample_points="300")  # -> out, vector_field, VertexPoints, VertexTangents; inputs interpolation_method: Int32, mesh: list, guiding_curves: list, n_sample_points: Int32
# ---------- vectorfield_generation: Python ----------
import numpy as np
import math
from scipy.sparse import coo_matrix, diags
from scipy.sparse.linalg import spsolve
import rhinoscriptsyntax as rs
import Rhino.Geometry as rg
import Grasshopper.Kernel.Types as ghtypes

tri_mesh = mesh[0]
V = tri_mesh.vertices
F = tri_mesh.faces
n_vertices = len(V)

# --- Common: Sample projected points and tangents from guiding curves ---
p_i, v_i, f_i = [], [], []
curves, curve_lengths = [], []
curves_total_length = 0.0

# Step 1: Coerce and measure all input curves
for curve_id in guiding_curves:
    try:
        curve = rs.coercecurve(curve_id)
    except:
        curve = getattr(curve_id, "Value", None)
    if not curve:
        continue
    curves.append(curve)
    length = curve.GetLength()
    curve_lengths.append(length)
    curves_total_length += length

# Step 2: Sample each curve and project its points + tangents to mesh
for j, curve in enumerate(curves):
    proportion = curve_lengths[j] / curves_total_length
    n = max(2, math.ceil(n_sample_points * proportion))
    domain = curve.Domain
    t_values = np.linspace(domain.T0, domain.T1, n)

    for t in t_values:
        pt = curve.PointAt(t)
        tan = curve.TangentAt(t)

        # Project point to mesh
        projected_pts, dists, face_ids = tri_mesh.nearest.on_surface([[pt.X, pt.Y, pt.Z]])
        projected = projected_pts[0]
        face_id = face_ids[0]

        # Project tangent to triangle plane
        tri = tri_mesh.faces[face_id]
        v0, v1, v2 = V[tri]
        tri_normal = np.cross(v1 - v0, v2 - v0)
        tri_normal /= np.linalg.norm(tri_normal)

        t_vec = np.array([tan.X, tan.Y, tan.Z])
        tan_proj = t_vec - np.dot(t_vec, tri_normal) * tri_normal

        p_i.append(projected)
        v_i.append(tan_proj)
        f_i.append(face_id)

# === METHOD 1: Laplacian-based interpolation (simple smoothing + barycentric weighting) ===
if interpolation_method == 1:
    accumulated = np.zeros((n_vertices, 3))
    weights = np.zeros(n_vertices)

    def barycentric_coords(p, tri):
        A = np.vstack((tri[1] - tri[0], tri[2] - tri[0])).T
        sol = np.linalg.lstsq(A, p - tri[0], rcond=None)[0]
        u, v = sol
        return np.array([1 - u - v, u, v])

    for pt, vec, fid in zip(p_i, v_i, f_i):
        tri = F[fid]
        bary = barycentric_coords(pt, V[tri])
        for k in range(3):
            vid = tri[k]
            accumulated[vid] += bary[k] * vec
            weights[vid] += bary[k]

    nonzero = weights > 1e-8
    interpolated = np.zeros_like(accumulated)
    interpolated[nonzero] = accumulated[nonzero] / weights[nonzero, None]

    # Laplacian smoothing (1-ring average)
    smoothed = interpolated.copy()
    for i in range(n_vertices):
        neighbors = tri_mesh.vertex_neighbors[i]
        if neighbors:
            smoothed[i] = 0.5 * interpolated[i] + 0.5 * interpolated[neighbors].mean(axis=0)

    field = smoothed

# === METHOD 2: Cotangent Laplace–Beltrami interpolation (global system solve) ===
elif interpolation_method == 2:

    def cotangent_laplacian(V, F):
        I, J, W = [], [], []
        areas = np.zeros(len(V))

        for tri in F:
            pts = V[tri]
            e0 = pts[1] - pts[0]
            e1 = pts[2] - pts[0]
            face_area = np.linalg.norm(np.cross(e0, e1)) * 0.5
            areas[tri] += face_area / 3

            for (i, j, k) in [(1, 2, 0), (2, 0, 1), (0, 1, 2)]:
                u = pts[j] - pts[k]
                v = pts[i] - pts[k]
                cot = np.dot(u, v) / np.linalg.norm(np.cross(u, v))
                I.extend([tri[i], tri[j]])
                J.extend([tri[j], tri[i]])
                W.extend([0.5 * cot, 0.5 * cot])

        C = coo_matrix((W, (I, J)), shape=(len(V), len(V))).tocsr()
        C.setdiag(-np.array(C.sum(axis=1)).flatten())
        M = diags(areas)
        return C, M

    C, M = cotangent_laplacian(V, F)
    lambda_param = 100.0  # controls smoothness vs fidelity
    A = M + lambda_param * C

    # Assign input data to nearest vertex (use simple KDTree from trimesh)
    v_data = np.zeros((n_vertices, 3))
    mask = np.zeros(n_vertices, dtype=bool)

    from scipy.spatial import cKDTree

    kdtree = cKDTree(V)  # V is your (n_vertices, 3) numpy array

    for pi, vi in zip(p_i, v_i):
        vid = kdtree.query(pi)[1]
        v_data[vid] = vi
        mask[vid] = True

    b = M @ v_data
    vx = spsolve(A, b[:, 0])
    vy = spsolve(A, b[:, 1])
    vz = spsolve(A, b[:, 2])
    field = np.vstack((vx, vy, vz)).T

# === Final: Project to tangent plane and output ===
normals = tri_mesh.vertex_normals
dotproj = np.einsum('ij,ij->i', field, normals)
tangent_field = field - dotproj[:, None] * normals

VertexPoints = [rg.Point3d(*v) for v in V]
VertexTangents = [rg.Vector3d(*v) for v in tangent_field]

vector_field = (V, tangent_field)

vector_field = np.array([tangent_field]).reshape(n_vertices, -1)
# ---------- end vectorfield_generation ----------
scale_2 = Scale(Geometry=vectorfield_generation.VertexTangents, Center=Point(0, 0, 0), Factor=0.1)  # -> Geometry, Transform
vdisex = VectorDisplayEx(Point=vectorfield_generation.VertexPoints, Vector=scale_2.Geometry, Colour=RGB(0, 0, 0), Width=2)

# ---- group: TEST
number_slider_2 = Slider(40, range=0..40)
number_slider_3 = Slider(0, range=0..1000)
py3 = Python3Script(curves=curve_data.curves)  # -> out, nodes, segments; inputs curves: list
# ---------- py3: Python ----------
# --- Module Imports & Setup ---

import importlib
import sys
import os
import numpy as np
import math
import rhinoscriptsyntax as rs
import Rhino
import meshlib.mrmeshpy as mr
import trimesh as tr
import Rhino.Geometry as rg

# Append module path
module_path = r"C:\Users\merli\Documents\Projects\surface_filling_curves\src\modules"
if module_path not in sys.path:
    sys.path.append(module_path)

# Import all modules
import check_intersection_mod
import checkAdjacent_mod
import connect_surface_points_mod
import doWork_mod
import get_tangent_basis_mod
import medial_axis_mod
import point_point_geodesic_mod
import remesh_curve_on_surface_mod
import sharedFace_mod
import surface_filling_energy_geodesic_mod
import surface_path_evolution_mod
import surface_point_value_mod
import surface_point_vector_field_mod
import SurfacePoint_mod
import trace_geodesic_mod

# To reload after edits:
for mod_name in [
    check_intersection_mod, checkAdjacent_mod, connect_surface_points_mod,
    doWork_mod, get_tangent_basis_mod, medial_axis_mod,
    point_point_geodesic_mod, remesh_curve_on_surface_mod,
    sharedFace_mod, surface_filling_energy_geodesic_mod,
    surface_path_evolution_mod, surface_point_value_mod,
    surface_point_vector_field_mod, SurfacePoint_mod,
    trace_geodesic_mod
]:
    importlib.reload(mod_name)


# Now bind the updated functions:
from surface_filling_energy_geodesic_mod import surface_filling_energy_geodesic
from surface_path_evolution_mod import surface_path_evolution
from doWork_mod import doWork
from medial_axis_mod import medial_axis
from SurfacePoint_mod import SurfacePoint
from connect_surface_points_mod import connect_surface_points


print(curves)

# Unpacking the goods
_nodes, _segments, _segmentSurfacePoints, _SegmentLengths, _isFixedNode = curves

nodes = [rg.Point3d(*sp.coord3d) for sp in _nodes]

segments = []
for j, seg in enumerate(_segments):
    path = [nodes[seg[0]]]
    for sp in _segmentSurfacePoints[j]:
        path.append(rg.Point3d(*sp.coord3d))
    path.append(nodes[seg[1]])  # ✅ Fix: not a list
    segments.append(rg.Polyline(path))
# ---------- end py3 ----------
item = ListItem(List=py3.segments, Index=Slider(127, range=0..254), Wrap=True)
item_2 = ListItem(List=py3.nodes, Index=Slider(205, range=0..254), Wrap=True)

# ----
pt_4 = Point()
pt_5 = Point()
test_boundary = Python3Script(mesh=mesh_data.mesh, sp1=pt_4, sp2=pt_5)  # -> out, boundary_vertices; inputs mesh: list
# ---------- test_boundary: Python ----------
import importlib
import sys
import os
import Rhino.Geometry as rg
import rhinoscriptsyntax as rs

# Append module path
module_path = r"C:\Users\merli\Documents\Projects\surface_filling_curves\src\modules"
if module_path not in sys.path:
    sys.path.append(module_path)

# Import all modules
import check_intersection_mod
import checkAdjacent_mod
import connect_surface_points_mod
#import doWork_mod
import get_tangent_basis_mod
import medial_axis_mod
import point_point_geodesic_mod
import remesh_curve_on_surface_mod
import sharedFace_mod
import surface_filling_energy_geodesic_mod
#import surface_path_evolution_mod
import surface_point_value_mod
import surface_point_vector_field_mod
import SurfacePoint_mod
import trace_geodesic_mod
import cache_boundary_vertices_mod


# To reload after edits:
for mod_name in [
    check_intersection_mod, checkAdjacent_mod, connect_surface_points_mod, get_tangent_basis_mod, medial_axis_mod,
    point_point_geodesic_mod, remesh_curve_on_surface_mod,
    sharedFace_mod, surface_filling_energy_geodesic_mod, surface_point_value_mod,
    surface_point_vector_field_mod, SurfacePoint_mod,
    trace_geodesic_mod, cache_boundary_vertices_mod
]:
    importlib.reload(mod_name)


# Now bind the updated functions:
from surface_filling_energy_geodesic_mod import surface_filling_energy_geodesic

from cache_boundary_vertices_mod import cache_boundary_vertices
from medial_axis_mod import medial_axis
from SurfacePoint_mod import SurfacePoint
from sharedFace_mod import sharedFace


# from the mesh:
tri_mesh, meshlib_mesh, solver, tracer = mesh

isBoundaryVertex = cache_boundary_vertices(tri_mesh)

boundary_vertices = []
for i,vertex in enumerate(tri_mesh.vertices):
    if tri_mesh.isBoundaryVertex[i]:
        boundary_vertices.append(rg.Point3d(*vertex))
# ---------- end test_boundary ----------
geo_3 = Geometry(test_boundary.boundary_vertices)
panel_2 = Panel(test_boundary.out)

test_principal_directions = Python3Script(mesh=mesh_data.mesh)  # -> out, vertices, principal_direction_1, principal_direction_2; inputs mesh: list
# ---------- test_principal_directions: Python ----------
import importlib
import sys
import os
import Rhino.Geometry as rg
import rhinoscriptsyntax as rs

# Append module path
module_path = r"C:\Users\merli\Documents\Projects\surface_filling_curves\src\modules"
if module_path not in sys.path:
    sys.path.append(module_path)

# Import all modules
import check_intersection_mod
import checkAdjacent_mod
import connect_surface_points_mod
#import doWork_mod
import get_tangent_basis_mod
import medial_axis_mod
import point_point_geodesic_mod
import remesh_curve_on_surface_mod
import sharedFace_mod
import surface_filling_energy_geodesic_mod
#import surface_path_evolution_mod
import surface_point_value_mod
import surface_point_vector_field_mod
import SurfacePoint_mod
import trace_geodesic_mod
import cache_boundary_vertices_mod


# To reload after edits:
for mod_name in [
    check_intersection_mod, checkAdjacent_mod, connect_surface_points_mod, get_tangent_basis_mod, medial_axis_mod,
    point_point_geodesic_mod, remesh_curve_on_surface_mod,
    sharedFace_mod, surface_filling_energy_geodesic_mod, surface_point_value_mod,
    surface_point_vector_field_mod, SurfacePoint_mod,
    trace_geodesic_mod, cache_boundary_vertices_mod
]:
    importlib.reload(mod_name)

from surface_filling_energy_geodesic_mod import surface_filling_energy_geodesic
from cache_boundary_vertices_mod import cache_boundary_vertices
from medial_axis_mod import medial_axis
from SurfacePoint_mod import SurfacePoint
from sharedFace_mod import sharedFace






# from the mesh:
tri_mesh, meshlib_mesh, solver, tracer = mesh



principal_direction_1 = []
principal_direction_2 = []
vertices = []


for i, vertex in enumerate(tri_mesh.vertices):
    vertices.append(rg.Point3d(*vertex))
    principal_direction_1.append(rg.Vector3d(*tri_mesh.principal_directions[i][0]))
    principal_direction_2.append(rg.Vector3d(*tri_mesh.principal_directions[i][1]))
# ---------- end test_principal_directions ----------
panel_3 = Panel(test_principal_directions.out)
geo_4 = Geometry(test_principal_directions.vertices)

# ----
# Example for alpha ratio on Mesh:  simply order them by height
demesh = DeconstructMesh(Mesh=mesh_data.rhino_mesh)  # -> Vertices, Faces, Colours, Normals
pdecon_3 = Deconstruct(Point=demesh.Vertices)  # -> XComponent, YComponent, ZComponent
py3_2 = Python3Script(z=pdecon_3.ZComponent)  # -> alphaRatioOnMesh; inputs z: list of Double
# ---------- py3_2: Python ----------
import numpy as np



arr = np.array(z, dtype=float)
xmin, xmax = arr.min(), arr.max()
y = 1 + (arr - xmin) / (xmax - xmin)
# If xmin == xmax, this gives nan; optionally handle constant list:
# y = np.ones_like(arr) if xmax == xmin else 1 + (arr - xmin)/(xmax - xmin)
# ---------- end py3_2 ----------

vdis = VectorDisplay(Anchor=test_principal_directions.vertices, Vector=test_principal_directions.principal_direction_2)
crv = Curve(py3.segments)
pt_6 = Point(py3.nodes)
line = Line(py3.segments)
vdis_2 = VectorDisplay(Anchor=test_principal_directions.vertices, Vector=test_principal_directions.principal_direction_1)
crv_2 = Curve(py3.segments)

# ----
# The medial axis term of the energy function of course penalizes curves that are not surface-filling.
# 
# The term doesn't get a weight, as its always involved
# (otherwise curve only converges to a point and vanishes).
# 
# Alpha is the ballancing coefficient, multiplied to the medial axis term,
# thus controlling its influence onto the entire energy function
# (hence the term "ballancing coefficient").
# 
# But you can also define alpha pointwise along the curve itself.
# This per-node alpha function can also be defined directly (alphaRatioOnNodes)
#  or be dependent on the mesh (alphaRatioOnMesh).
# 
# Finally, q is the power value in the medial axis term.
number_slider_4 = Slider(1, range=1..5)
list_2 = ValueList({"Use constant alpha": useConstantAlpha, "Use Anisotropic Alpha on Nodes": useAnisotropicAlphaOnNodes, "Use Anisotropic Alpha on Mesh": useAnisotropicAlphaOnMesh}, selected="Use constant alpha")
medial_axis_energy_term = Python3Script(
    options=list_2,
    radius=Slider(0.88, range=0..10),
    alphaRatioOnNodes=number_slider_4,
    alphaRatioOnMesh=py3_2,
    q=Slider(5, range=1..5),
    maxRadius=Slider(0.106, range=0..10))  # -> out, medial_axis_options; inputs options: String, q: Double, maxRadius: Double
# ---------- medial_axis_energy_term: Python ----------
# Packing the Goods

if options == 'useAnisotropicAlphaOnNodes': # THIS DOESNT HAVE TO BE EITHER OR;
    useAnisotropicAlphaOnMesh = False       #COULD ALSO USE BOTH AT THE SAME TIME (WITH WEIGHTS)
    useAnisotropicAlphaOnNodes = True

elif options == 'useAnisotropicAlphaOnMesh':
    useAnisotropicAlphaOnMesh = True
    useAnisotropicAlphaOnNodes = False

else:
    useAnisotropicAlphaOnNodes = False
    useAnisotropicAlphaOnMesh = False

    

medial_axis_options = [useAnisotropicAlphaOnNodes, useAnisotropicAlphaOnMesh, radius, alphaRatioOnNodes, alphaRatioOnMesh, q, maxRadius]
# ---------- end medial_axis_energy_term ----------

# ----
# This is the second derivative smoothness energy, enforcing smooth variation between curve segments
number_slider_5 = Slider(0, range=0..1)
curvature_energy_term = Python3Script(w_curvatureAlignedness=number_slider_5)  # -> curvatureAlignedness_options; inputs w_curvatureAlignedness: Double
# ---------- curvature_energy_term: Python ----------
curvatureAlignedness_options = w_curvatureAlignedness
# ---------- end curvature_energy_term ----------

number_slider_6 = Slider(1, range=0..1)
vectorfield_align_energy_term = Python3Script(w_fieldAlignedness=Slider(0, range=0..10), vector_field=vectorfield_generation.vector_field)  # -> vector_field_options
# ---------- vectorfield_align_energy_term: Python ----------
"""Grasshopper Script"""
a = "Hello Python 3 in Grasshopper!"
print(a)


vector_field_options = [w_fieldAlignedness, vector_field]
# ---------- end vectorfield_align_energy_term ----------

# ----
# This is the second derivative smoothness energy, enforcing smooth variation between curve segments
number_slider_7 = Slider(0, range=0..1)
biharmonic_energy_term = Python3Script(w_biharmonic=number_slider_7)  # -> biharmonic_options; inputs w_biharmonic: Double
# ---------- biharmonic_energy_term: Python ----------
biharmonic_options = w_biharmonic
# ---------- end biharmonic_energy_term ----------

shortest_curve_energy_term = Python3Script(p=Slider(1.272, range=1..5))  # -> shortest_curve_options; inputs p: Double
# ---------- shortest_curve_energy_term: Python ----------
shortest_curve_options = p
# ---------- end shortest_curve_energy_term ----------

pt_7 = Point(<point referenced from the Rhino model>)
pt_8 = Point(<point referenced from the Rhino model>)
test_point_point_geodesic = Python3Script(mesh=mesh_data.mesh, sp1=pt_7, sp2=pt_8)  # -> out, path; inputs mesh: list
# ---------- test_point_point_geodesic: Python ----------
import importlib
import sys
import os
import Rhino.Geometry as rg
import rhinoscriptsyntax as rs

# Append module path
module_path = r"C:\Users\merli\Documents\Projects\surface_filling_curves\src\modules"
if module_path not in sys.path:
    sys.path.append(module_path)

# Import all modules
import check_intersection_mod
import checkAdjacent_mod
import connect_surface_points_mod
#import doWork_mod
import get_tangent_basis_mod
import medial_axis_mod
import point_point_geodesic_mod
import remesh_curve_on_surface_mod
import sharedFace_mod
import surface_filling_energy_geodesic_mod
#import surface_path_evolution_mod
import surface_point_value_mod
import surface_point_vector_field_mod
import SurfacePoint_mod
import trace_geodesic_mod
import cache_boundary_vertices_mod


# To reload after edits:
for mod_name in [
    check_intersection_mod, checkAdjacent_mod, connect_surface_points_mod, get_tangent_basis_mod, medial_axis_mod,
    point_point_geodesic_mod, remesh_curve_on_surface_mod,
    sharedFace_mod, surface_filling_energy_geodesic_mod, surface_point_value_mod,
    surface_point_vector_field_mod, SurfacePoint_mod,
    trace_geodesic_mod, cache_boundary_vertices_mod
]:
    importlib.reload(mod_name)


# Now bind the updated functions:
from surface_filling_energy_geodesic_mod import surface_filling_energy_geodesic

from cache_boundary_vertices_mod import cache_boundary_vertices
from medial_axis_mod import medial_axis
from SurfacePoint_mod import SurfacePoint
from sharedFace_mod import sharedFace
from point_point_geodesic_mod import point_point_geodesic

# from the mesh:
tri_mesh, meshlib_mesh, solver, tracer, dictionary = mesh
#from the points:
sp1 = rs.coerce3dpoint(sp1)
sp2 = rs.coerce3dpoint(sp2)


sp1 = SurfacePoint.from_position([sp1.X,sp1.Y,sp1.Z], tri_mesh, tolerance=1e-6)
sp2 = SurfacePoint.from_position([sp2.X,sp2.Y,sp2.Z], tri_mesh, tolerance=1e-6)

_path, length = point_point_geodesic(tri_mesh, meshlib_mesh, sp1, sp2, solver, dictionary)

print('TESTTTTTT')
print(_path)


path = []
for vertex in _path:
    path.append(rg.Point3d(*vertex.coord3d))
# ---------- end test_point_point_geodesic ----------
geo_5 = Geometry(test_point_point_geodesic.path)
panel_4 = Panel(test_point_point_geodesic.out)

pt_9 = Point(<point referenced from the Rhino model>)
pt_10 = Point(<point referenced from the Rhino model>)
test_point_point_geodesic_proj = Python3Script(mesh=mesh_data.mesh, sp1=pt_9, sp2=pt_10)  # -> out, path; inputs mesh: list
# ---------- test_point_point_geodesic_proj: Python ----------
import importlib
import sys
import os
import Rhino.Geometry as rg
import rhinoscriptsyntax as rs

# Append module path
module_path = r"C:\Users\merli\Documents\Projects\surface_filling_curves\src\modules"
if module_path not in sys.path:
    sys.path.append(module_path)

# Import all modules
import check_intersection_mod
import checkAdjacent_mod
import connect_surface_points_mod
#import doWork_mod
import get_tangent_basis_mod
import medial_axis_mod
import point_point_geodesic_proj_mod
import remesh_curve_on_surface_mod
import sharedFace_mod
import surface_filling_energy_geodesic_mod
#import surface_path_evolution_mod
import surface_point_value_mod
import surface_point_vector_field_mod
import SurfacePoint_mod
import trace_geodesic_mod
import cache_boundary_vertices_mod


# To reload after edits:
for mod_name in [
    check_intersection_mod, checkAdjacent_mod, connect_surface_points_mod, get_tangent_basis_mod, medial_axis_mod,
    point_point_geodesic_proj_mod, remesh_curve_on_surface_mod,
    sharedFace_mod, surface_filling_energy_geodesic_mod, surface_point_value_mod,
    surface_point_vector_field_mod, SurfacePoint_mod,
    trace_geodesic_mod, cache_boundary_vertices_mod
]:
    importlib.reload(mod_name)


# Now bind the updated functions:
from surface_filling_energy_geodesic_mod import surface_filling_energy_geodesic

from cache_boundary_vertices_mod import cache_boundary_vertices
from medial_axis_mod import medial_axis
from SurfacePoint_mod import SurfacePoint
from sharedFace_mod import sharedFace
from point_point_geodesic_proj_mod import point_point_geodesic

# from the mesh:
tri_mesh, meshlib_mesh, solver, tracer, dictionary = mesh
#from the points:
sp1 = rs.coerce3dpoint(sp1)
sp2 = rs.coerce3dpoint(sp2)


sp1 = SurfacePoint.from_position([sp1.X,sp1.Y,sp1.Z], tri_mesh, tolerance=1e-6)
sp2 = SurfacePoint.from_position([sp2.X,sp2.Y,sp2.Z], tri_mesh, tolerance=1e-6)

_path, length = point_point_geodesic(tri_mesh, meshlib_mesh, sp1, sp2, solver, dictionary)

print('TESTTTTTT')
print(_path)


path = []
for vertex in _path:
    path.append(rg.Point3d(*vertex.coord3d))
# ---------- end test_point_point_geodesic_proj ----------
geo_6 = Geometry(test_point_point_geodesic_proj.path)
panel_5 = Panel(test_point_point_geodesic_proj.out)

start = BooleanToggle(True)
py3_3 = Python3Script(
    start=start,
    n_iterations="1",
    mesh=mesh_data.mesh,
    curves=curve_data.curves,
    medial_axis_options=medial_axis_energy_term.medial_axis_options,
    biharmonic_options=biharmonic_energy_term,
    vector_field_options=vectorfield_align_energy_term,
    shortest_curve_options=shortest_curve_energy_term,
    curvatureAlignedness_options=curvature_energy_term)  # -> out, graft(iterations), polylines, segments, nodes, graft(lengths); inputs n_iterations: Int32, mesh: list, curves: list, medial_axis_options: list, vector_field_options: list, shortest_curve_options: list, curvatureAlignedness_options: Double
# ---------- py3_3: Python ----------
import importlib
import sys
import os
import Rhino.Geometry as rg

# Append module path
module_path = r"C:\Users\merli\Documents\Projects\surface_filling_curves\src\modules"
if module_path not in sys.path:
    sys.path.append(module_path)

# Import all modules
import check_intersection_mod
import checkAdjacent_mod
import connect_surface_points_mod
import single_iteration_mod
import get_tangent_basis_mod
import medial_axis_mod
import point_point_geodesic_mod
import remesh_curve_on_surface_mod
import sharedFace_mod
import surface_filling_energy_geodesic_mod
import surface_path_evolution_mod
import surface_point_value_mod
import surface_point_vector_field_mod
import SurfacePoint_mod
import trace_geodesic_mod
import generate_surface_filling_curve_mod

# To reload after edits:
for mod_name in [
    check_intersection_mod, checkAdjacent_mod, connect_surface_points_mod,
    single_iteration_mod, get_tangent_basis_mod, medial_axis_mod,
    point_point_geodesic_mod, remesh_curve_on_surface_mod,
    sharedFace_mod, surface_filling_energy_geodesic_mod,
    surface_path_evolution_mod, surface_point_value_mod,
    surface_point_vector_field_mod, SurfacePoint_mod,
    trace_geodesic_mod, generate_surface_filling_curve_mod
]:
    importlib.reload(mod_name)


# Now bind the updated functions:
from surface_filling_energy_geodesic_mod import surface_filling_energy_geodesic
from surface_path_evolution_mod import surface_path_evolution
from single_iteration_mod import single_iteration
from medial_axis_mod import medial_axis
from SurfacePoint_mod import SurfacePoint
from generate_surface_filling_curve_mod import generate_surface_filling_curve

iteration = 0

# 0. UNPACKING THE GOODS

# from the mesh:
tri_mesh, meshlib_mesh, solver, tracer, dictionary = mesh

# from the curves:
nodes, segments, segmentSurfacePoints, segmentLengths, isFixedNode = curves 

# from the medial_axis_options:
useAnisotropicAlphaOnNodes, useAnisotropicAlphaOnMesh, radius, alphaRatioOnNodes, alphaRatioOnMesh, q, maxRadius = medial_axis_options

# from the vectorfield:
w_fieldAlignedness, vector_field = vector_field_options

# from the shortest curve term:
p = shortest_curve_options

# from the biharmonic term:
w_biharmonic = biharmonic_options

# from the curvature alignedness energy term
w_curvatureAlignedness = curvatureAlignedness_options

# NOW RUN THE ALGORITHM

if start:
    curve_iterations = generate_surface_filling_curve(n_iterations, nodes, segments, segmentSurfacePoints, segmentLengths, isFixedNode,
            tri_mesh, meshlib_mesh, solver, tracer, dictionary,
            vector_field,
            maxRadius, radius,
            useAnisotropicAlphaOnNodes, useAnisotropicAlphaOnMesh,
            alphaRatioOnNodes, alphaRatioOnMesh,
            w_fieldAlignedness, w_curvatureAlignedness, w_biharmonic,
            p, q
        )
    
'''
mA = []
for i in medialAxis:
    mA += i
'''
iterations = []
polylines = []
lengths = []

for entry in curve_iterations:

    _iteration = entry["iteration"]
    _nodes = entry["nodes"]
    _segments = entry["segments"]
    _segmentSurfacePoints = entry["segmentSurfacePoints"]
    _segmentLengths = entry["segmentLengths"]

    #print(_nodes)
    print(_segments)

    iterations.append(_iteration)

    nodes = [rg.Point3d(*sp.coord3d) for sp in _nodes]

    segments = []
    for j, seg in enumerate(_segments):
        path = [nodes[seg[0]]]
        for sp in _segmentSurfacePoints[j]:
            path.append(rg.Point3d(*sp.coord3d))
            #print(rg.Point3d(*sp.coord3d))
        path.append(nodes[seg[1]])  # ✅ Fix: not a list
        polyline = rg.PolylineCurve(rg.Polyline(path))
        #print(polyline)
        #segments.append(path)
        segments.append(polyline)

    joined = rg.Curve.JoinCurves(segments, 0.0001)
    #print(segments)

    polylines.append(joined)

    lengths.append(sum(_segmentLengths))

nodes = [rg.Point3d(*sp.coord3d) for sp in _nodes]

segments = []
for j, seg in enumerate(_segments):
    path = [nodes[seg[0]]]
    for sp in _segmentSurfacePoints[j]:
        path.append(rg.Point3d(*sp.coord3d))
        #print(rg.Point3d(*sp.coord3d))
    path.append(nodes[seg[1]])  # ✅ Fix: not a list
    polyline = rg.PolylineCurve(rg.Polyline(path))
    #print(polyline)
    #segments.append(path)
    segments.append(polyline)

'''
for data in curve_iterations:

    _iteration, _nodes, _segments, _segmentSurfacePoints, _segmentLengths = data

    iterations.append(_iteration)

    print(_nodes)

    nodes = [rg.Point3d(*sp.coord3d) for sp in _nodes]

    segments = []
    for j, seg in enumerate(_segments):
        path = [nodes[seg[0]]]
        for sp in _segmentSurfacePoints[j]:
            path.append(rg.Point3d(*sp.coord3d))
        path.append(nodes[seg[1]])  # ✅ Fix: not a list
        segments.append(rg.Polyline(path))

    polylines.append(segments)

    lengths.append(sum(_segmentLengths))
    
'''
# ---------- end py3_3 ----------
number_slider_8 = Slider(0, range=0..10)
pt_11 = Point(py3_3.nodes)
crv_3 = Curve(py3_3.segments)
item_3 = ListItem(List=py3_3.iterations, Index=number_slider_8, Wrap=True)
item_4 = ListItem(List=py3_3.lengths, Index=number_slider_8, Wrap=True)
item_5 = ListItem(List=py3_3.polylines, Index=number_slider_8, Wrap=True)
panel_6 = Panel(py3_3.polylines)
panel_7 = Panel(item_5)
panel_8 = Panel(item_4)
