# Grasshopper definition wall.gh (Grasshopper 1.0.8)

multiplication = Multiplication(A=Slider(4, range=0..100), B=2)
vec = VectorXYZ(XComponent=Slider(10, range=0..10), YComponent=0, ZComponent=0)  # -> Vector, Length
addition = Addition(A=multiplication, B=1)
pt = ConstructPoint(XCoordinate=0, YCoordinate=0, ZCoordinate=0)
arrlinear = LinearArray(Geometry=pt, Direction=vec.Vector, Count=addition)  # -> Geometry, Transform
series = Series(Start=0, Step=vec.Vector, Count=addition)
Y = UnitY(Factor=series)
move = Move(Geometry=arrlinear.Geometry, Motion=graft(Y))  # -> Geometry, Transform
sort_pt = SortPoints(Points=flatten(move.Geometry))  # -> Points, Indices
dispatch = Dispatch(List=flatten(sort_pt.Points), DispatchPattern=[True, False])  # -> ListA, ListB
xz = XZPlane(Origin=Point(0, 0, 0))
Z = UnitZ(Factor=Slider(4.594, range=0..10))
move_2 = Move(Geometry=dispatch.ListA, Motion=Z)  # -> Geometry, Transform
geo = Geometry([move_2.Geometry, dispatch.ListB])
sort_pt_2 = SortPoints(Points=geo)  # -> Points, Indices
pdecon = Deconstruct(Point=sort_pt_2.Points)  # -> XComponent, YComponent, ZComponent
partition = PartitionList(List=sort_pt_2.Points, Size=9)
intcrv_t = InterpolateT(Vertices=partition, TangentStart=Vector(0, 0, 0), TangentEnd=Vector(0, 0, 0), KnotStyle=1)  # -> flatten(Curve), Length, Domain
sort = SortList(Keys=pdecon.YComponent, ValuesA=sort_pt_2.Points)  # -> Keys, ValuesA
srfgrid = SurfaceFromPoints(Points=sort_pt_2.Points, UCount=addition, Interpolate=False)  # disabled
partition_2 = PartitionList(List=sort.ValuesA, Size=9)
pdecon_2 = Deconstruct(Point=partition_2)  # -> XComponent, YComponent, ZComponent
sort_2 = SortList(Keys=pdecon_2.XComponent, ValuesA=partition_2)  # -> Keys, ValuesA
intcrv_t_2 = InterpolateT(Vertices=sort_2.ValuesA, TangentStart=Vector(0, 0, 0), TangentEnd=Vector(0, 0, 0), KnotStyle=1)  # -> flatten(Curve), Length, Domain
netsurf = NetworkSurface(CurvesU=intcrv_t.Curve, CurvesV=intcrv_t_2.Curve, Continuity=2)
rotate = Rotate(Geometry=netsurf, Angle=1.570796327, Plane=xz)  # -> Geometry, Transform

lion_projected = Curve([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])
lion = Curve([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])

funnel_polysrf = Brep(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)
funnel_mantle = Surface(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)

starting_curve = Curve(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)
py3 = Python3Script(surface=funnel_mantle, curve=starting_curve)  # -> out, a, gh_points, mesh
# ---------- py3: Python ----------
import Rhino
import rhinoscriptsyntax as rs
import scriptcontext as sc
import numpy as np


from Rhino.Geometry import MeshingParameters, Mesh, MeshFace, Point3d

# the number of nodes that we seperate our curve into
node_count = 100


# --- Coerce inputs ---
brep = rs.coercebrep(surface)
crv = rs.coercecurve(curve)

if not brep or not crv:
    raise Exception("Invalid surface or curve input.")

# --- Mesh the surface ---
mp = MeshingParameters.Default
mesh_parts = Mesh.CreateFromBrep(brep, mp)

mesh = Mesh()
for m in mesh_parts:
    mesh.Append(m)

# --- Extract vertices (for reference or debugging) ---
V = np.array([[v.X, v.Y, v.Z] for v in mesh.Vertices])

# --- Extract triangle faces ---
F = []
for f in mesh.Faces:
    if f.IsTriangle:
        F.append([f.A, f.B, f.C])
    else:
        F.append([f.A, f.B, f.C])
        F.append([f.A, f.C, f.D])
F = np.array(F, dtype=np.int32)

# --- Discretize curve ---
t_vals = np.linspace(crv.Domain.T0, crv.Domain.T1, node_count)
curve_points = [crv.PointAt(t) for t in t_vals]

# --- Set Grasshopper outputs ---
gh_mesh = mesh
gh_points = curve_points
print(curve_points,mesh)
# ---------- end py3 ----------
mesh = Mesh(py3.mesh)
pt_2 = Point(py3.gh_points)
